# Grasshopper definition 110614_defineMeshedges_CreateSrf_DeDackel.ghx (Grasshopper 0.8.10)

# ----
# QuadMesh
mesh = Mesh(<mesh referenced from the Rhino model>)

# ----
# TriangleMesh
mesh_2 = Mesh(<mesh referenced from the Rhino model>)

mcomp = Decompose(Mesh=mesh)  # -> Vertices, Faces, Colours, Normals
mcomp_2 = Decompose(Mesh=mesh_2)  # -> Vertices, Faces, Colours, Normals
vertices = FaceVertices(Face=mcomp.Faces)  # -> CornerA, CornerB, CornerC, CornerD
vertices_2 = FaceVertices(Face=mcomp_2.Faces)  # -> CornerA, CornerB, CornerC, CornerD
flatten = FlattenTree(Data=mcomp.Vertices, Path="{0}")
flatten_2 = FlattenTree(Data=vertices.CornerA, Path="{0}")
flatten_3 = FlattenTree(Data=vertices.CornerB, Path="{1}")
flatten_4 = FlattenTree(Data=vertices.CornerC, Path="{2}")
flatten_5 = FlattenTree(Data=vertices.CornerD, Path="{3}")
flatten_6 = FlattenTree(Data=mcomp_2.Vertices, Path="{0}")
flatten_7 = FlattenTree(Data=vertices_2.CornerA, Path="{0}")
flatten_8 = FlattenTree(Data=vertices_2.CornerB, Path="{1}")
flatten_9 = FlattenTree(Data=vertices_2.CornerC, Path="{2}")
merge = MergeMultiple(Stream0=flatten_2, Stream1=flatten_3, Stream2=flatten_4, Stream3=flatten_5)
merge_2 = MergeMultiple(Stream0=flatten_7, Stream1=flatten_8, Stream2=flatten_9)
flip = FlipMatrix(Data=merge)
flip_2 = FlipMatrix(Data=merge_2)
item = ListItem(List=flatten, Index=flip, Wrap=False)
item_2 = ListItem(List=flatten_6, Index=flip_2, Wrap=False)

panel = Panel("EdgePolyCrv")
pline = PolyLine(Vertices=item, Closed=True)
pline_2 = PolyLine(Vertices=item_2, Closed=True)

explode = Explode(Curve=pline, Recursive=True)  # -> Segments, Vertices
explode_2 = Explode(Curve=pline_2, Recursive=True)  # -> Segments, Vertices
item_3 = ListItem(List=explode.Segments, Index=Slider(0, range=0..3), Wrap=False)
item_4 = ListItem(List=explode.Segments, Index=Slider(1, range=0..3), Wrap=False)
item_5 = ListItem(List=explode.Segments, Index=Slider(2, range=0..3), Wrap=False)
item_6 = ListItem(List=explode.Segments, Index=Slider(3, range=0..3), Wrap=False)
item_7 = ListItem(List=explode_2.Segments, Index=Slider(0, range=0..3), Wrap=False)
item_8 = ListItem(List=explode_2.Segments, Index=Slider(1, range=0..3), Wrap=False)
item_9 = ListItem(List=explode_2.Segments, Index=Slider(2, range=0..3), Wrap=False)
edgesrf = EdgeSurface(CurveA=item_3, CurveB=item_4, CurveC=item_5, CurveD=item_6)
edgesrf_2 = EdgeSurface(CurveA=item_7, CurveB=item_8, CurveC=item_9)

panel_3 = Panel("PolySrf")
join = BrepJoin(Breps=flatten(edgesrf))  # -> Breps, Closed
join_2 = BrepJoin(Breps=flatten(edgesrf_2))  # -> Breps, Closed
