# Grasshopper definition 12FA_TopoLab_Slope Analysis.gh (Grasshopper 0.9.14)

slider = Slider(50, range=0..100)
range = Range(Domain="0 to 2*pi", Steps=slider)
multiplication = Multiplication(A=range, B=Slider(4, range=0..10))
range_2 = Range(Domain="0 to 2*pi", Steps=slider)
pt = PointXYZ(XComponent=graft(multiplication), YComponent=range_2, ZComponent=0, System=PlaneXY(0, 0, 0))  # -> graft(Point)
pcomp = Decompose(Point=pt, System=PlaneXY(0, 0, 0))  # -> XComponent, YComponent, ZComponent
graph = GraphMapper(
    pcomp.XComponent,
    x0=0,
    x1=10,
    y0=0,
    y1=10,
    container_name="Bezier",
    cpx=[0, 0.6756851077, 0.5836206675, 1],
    cpy=[0, 0.7282608151, 0, 0.8822466135])
graph_2 = GraphMapper(
    pcomp.YComponent,
    x0=0,
    x1=1,
    y0=0,
    y1=1,
    container_name="Sine",
    Equation_px=[0, 1],
    Equation_py=[0.3531157374, 0.1928783655])
multiplication_2 = Multiplication(A=graph, B=graph_2)
pt_2 = PointXYZ(XComponent=pcomp.XComponent, YComponent=pcomp.YComponent, ZComponent=multiplication_2, System=PlaneXY(0, 0, 0))
srfgrid = SurfaceFromPoints(Points=flatten(pt_2), UCount=expr("U+1", slider), Interpolate=False)

slider_2 = Slider(100, range=0..100)
mesh_uv = MeshSurface(Surface=srfgrid, UCount=slider_2, VCount=slider_2, Overhang=True, Equalize=False)
mcomp = Decompose(Mesh=mesh_uv)  # -> Vertices, Faces, Colours, Normals
pcomp_2 = Decompose(Point=mcomp.Vertices)  # -> XComponent, YComponent, ZComponent
panel = Panel("ELEVATION")
panel_2 = Panel("SLOPE")
unit = UnitVector(Vector=mcomp.Normals)
bnd = Bounds(Numbers=pcomp_2.ZComponent)
multiplication_3 = Multiplication(A=pcomp_2.ZComponent, B=Slider(10, range=0..10))
addition = Addition(A=multiplication_3, B=Slider(1, range=0..10))
vcomp = Decompose(Vector=unit)  # -> XComponent, YComponent, ZComponent
division = Division(A=Slider(10, range=0..10), B=addition)
division_2 = Division(A=division, B=Slider(1, range=0..20))
panel_3 = Panel("SLOPE + ELEVATION")
addition_2 = Addition(A=vcomp.ZComponent, B=division_2)
bnd_2 = Bounds(Numbers=addition_2)
panel_4 = Panel(bnd_2)
multiplication_4 = Multiplication(A=addition_2, B=Slider(2.4, range=0..5))
gradient = Gradient(
    LowerLimit=0,
    UpperLimit=4,
    Parameter=expr("Abs(t)", multiplication_4),
    stops=[0: RGB(234, 38, 0), 0.25: RGB(234, 126, 0), 0.5: RGB(254, 244, 84), 0.75: RGB(173, 203, 249), 1: RGB(75, 107, 169)])
bnd_3 = Bounds(Numbers=multiplication_4)
panel_5 = Panel(bnd_3)
mcol = MeshColours(Mesh=mesh_uv, Colours=gradient)

contour = Contour(Shape=srfgrid, Point=Point(0, 0, 0), Direction=Vector(0, 0, 1), Distance=Slider(0.1, range=0..10))
preview = CustomPreview(
    Geometry=srfgrid,
    Shader={diffuse=RGB(255, 105, 180), ambient=RGB(0, 0, 0), emission=RGB(76, 32, 54), specular=RGB(255, 255, 255), shine=0.5, transparency=0})

mesh = Mesh(mesh_uv)
mcomp_2 = Decompose(Mesh=mesh)  # -> Vertices, Faces, Colours, Normals
vcomp_2 = Decompose(Vector=mcomp_2.Normals)  # -> XComponent, YComponent, ZComponent
eval = Evaluate(F="Deg(0.0 - (Asin(Abs(z)) - .5*Pi))", z=vcomp_2.ZComponent)
panel_6 = Panel("COLOR MESH")
panel_7 = Panel("""CULL SLOPE 

_[-]
_[+]
_[- <> +]
_[(...)]""")
degrees = Slider(10, range=0..90)
degrees_2 = Slider(22, range=0..90)
degrees_3 = Slider(26, range=0..90)
degrees_4 = Slider(51, range=0..90)
degrees_5 = Slider(15, range=0..90)
tolerance = Slider(28, range=0..90)
gradient_2 = Gradient(
    LowerLimit=0,
    UpperLimit=90,
    Parameter=eval,
    stops=[0.166: RGB(0, 0, 115), 0.394: RGB(166, 255, 0), 0.544: RGB(240, 172, 36), 0.797: RGB(255, 0, 0)])
similar = Similarity(FirstNumber=eval, SecondNumber=degrees_5, Threshold=tolerance)  # -> Similarity, AbsoluteDifference
smaller = SmallerThan(FirstNumber=eval, SecondNumber=degrees)  # -> SmallerThan, OrEqualTo
larger = LargerThan(FirstNumber=eval, SecondNumber=degrees_2)  # -> LargerThan, OrEqualTo
mcol_2 = MeshColours(Mesh=mesh_uv, Colours=gradient_2)
dom = Domain(DomainStart=degrees_4, DomainEnd=degrees_3)
inc = Includes(Value=flatten(eval), Domain=dom)  # -> Includes, Deviation
cull = CullPattern(List=mcomp_2.Vertices, CullPattern=smaller.SmallerThan)
cull_2 = CullPattern(List=mcomp_2.Vertices, CullPattern=larger.LargerThan)
cull_3 = CullPattern(List=mcomp_2.Vertices, CullPattern=inc.Includes)
cull_4 = CullPattern(List=mcomp_2.Vertices, CullPattern=similar.Similarity)
panel_8 = Panel("PLACE GEOMETRY")
pt_3 = Point(cull)
geo_height = Slider(2, range=0..90)
circle = CircleCNR(Center=pt_3, Normal=Vector(0, 0, 1), Radius=Slider(0.05, range=0..1))
Z = UnitZ(Factor=geo_height)
extr = Extrude(Base=circle, Direction=Z)

panel_9 = Panel("FLOWPATHS")
srf = Surface(srfgrid)

pcomp_3 = Decompose(Point=pt_3, System=PlaneXY(0, 0, 0))  # -> XComponent, YComponent, ZComponent
addition_3 = Addition(A=0.1, B=pcomp_3.ZComponent)
multiplication_5 = Multiplication(A=addition_3, B=Slider(0.05, range=0..2))
circle_2 = CircleCNR(Center=pt_3, Normal=Vector(0, 0, 1), Radius=multiplication_5)
project = Project(Curve=circle_2, Brep=srf, Direction=Vector(0, 0, 1))

srf_2 = Surface(srfgrid)

crv = Curve(<curve referenced from the Rhino model>)
project_2 = Project(Curve=crv, Brep=srf, Direction=Vector(0, 0, 1))
end = EndPoints(Curve=project_2)  # -> Start, End
starting_point = Point(end.Start)
ending_point = Point(end.End)
srf_3 = Surface(srf_2)
vb = VBScript(srf=srf_3, stp=starting_point, edp=ending_point, res=Slider(0.5, range=0..1), slope=Slider(6, range=1..12))  # -> out, A; inputs srf: Surface, stp: Point3d, edp: Point3d
# ---------- vb: VB ----------
    Dim input_pt As Point3d = stp
    Dim output_pt As point3d
    Dim output_pt_list As New List(Of point3d)
    output_pt_list.Add(input_pt)

    For i As Integer = 0 To 50

      NextPoint(srf, input_pt, edp, res, slope, output_pt)

      Dim dist_check As Double = output_pt.DistanceTo(edp)

      If dist_check < res Then
        output_pt_list.add(edp)
        Exit For
      Else
        output_pt_list.add(output_pt)
        input_pt = output_pt
      End If

    Next

    Dim path As Curve = curve.CreateInterpolatedCurve(output_pt_list.ToArray, 3)

    A = path
# ---------- vb: VB additional code ----------
  Private Sub NextPoint(ByVal srf As Surface, ByVal stp As Point3d, ByVal edp As Point3d, ByVal res As Double, ByVal slope As Integer, ByRef A As Object)

    '///// get the shortest path on a surface

    Dim u0,u1,v0,v1 As Double
    srf.ClosestPoint(stp, u0, v0)
    srf.ClosestPoint(edp, u1, v1)

    Dim stp2d As New Point2d(u0, v0)
    Dim edp2d As New Point2d(u1, v1)

    Dim short_path As curve = srf.ShortPath(stp2d, edp2d, 0)

    '///// get the slope vector on the path

    Dim slope_vec As vector3d = short_path.TangentAt(0)
    slope_vec.Unitize

    '///// get the slope of the vector on the path (with z vector)

    Dim angle As Double = vector3d.VectorAngle(vector3d.ZAxis, slope_vec)
    angle = angle / (math.PI) * 180

    '///// set max/min walkable slope angles

    Dim refslope As Double = math.Atan(1 / slope)
    Dim dnhillslope, uphillslope As Double
    uphillslope = 90 - refslope / (math.PI ) * 180
    dnhillslope = 90 + refslope / (math.PI ) * 180

    '///// check cases based on angle

    Dim vec_out As vector3d

    If angle < uphillslope Or angle > dnhillslope Then

      Dim nor_vec As New vector3d(srf.NormalAt(u0, v0))
      Dim vec_out_cw, vec_out_ccw As vector3d
      Dim slope_vec_rot_cw As vector3d = slope_vec
      Dim slope_vec_rot_ccw As vector3d = slope_vec

      For i As Integer = 0 To -180 Step -5
        slope_vec_rot_cw.Rotate(i * math.PI / 180, nor_vec)
        Dim check_angle As Double = vector3d.VectorAngle(vector3d.ZAxis, slope_vec_rot_cw)
        check_angle = check_angle / (math.PI) * 180
        If check_angle >= uphillslope And check_angle <= dnhillslope Then
          vec_out_cw = slope_vec_rot_cw
          Exit For
        End If
      Next

      For i As Integer = 0 To 180 Step 5
        slope_vec_rot_ccw.Rotate(i * math.PI / 180, nor_vec)
        Dim check_angle As Double = vector3d.VectorAngle(vector3d.ZAxis, slope_vec_rot_ccw)
        check_angle = check_angle / (math.PI) * 180
        If check_angle >= uphillslope And check_angle <= dnhillslope Then
          vec_out_ccw = slope_vec_rot_ccw
          Exit For
        End If
      Next

      Dim check_pt_cw As Point3d = stp + vec_out_cw
      Dim check_pt_ccw As Point3d = stp + vec_out_ccw

      Dim check_dist_cw As Double = edp.DistanceTo(check_pt_cw)
      Dim check_dist_ccw As Double = edp.DistanceTo(check_pt_ccw)

      If check_dist_cw > check_dist_ccw Then
        vec_out = vec_out_ccw
      Else
        vec_out = vec_out_cw
      End If

    Else

      vec_out = slope_vec

    End If

    Dim nextpt As point3d = stp + vec_out * res

    Dim u,v As Double

    srf.ClosestPoint(nextpt, u, v)

    Dim output_pt As point3d = srf.PointAt(u, v)

    A = output_pt

  End Sub
# ---------- end vb ----------
crv_2 = Curve(vb.A)

distance_factor = Slider(0.1, range=0.1..1.1)
sdivide = DivideSurface(Surface=srf, UCount=Slider(50, range=0..100), VCount=Slider(50, range=0..100))  # -> Points, Normals, Parameters
flowlines = VBScript(base_srf=srf, input_pt=sdivide.Points, distance_factor=distance_factor)  # -> out, A; inputs base_srf: Surface, input_pt: list of Point3d
# ---------- flowlines: VB ----------
    Dim output_crvs As New List(Of PolylineCurve)

    For Each pt As point3d In input_pt

      Dim output_pts As New List(Of Point3d)

      output_pts.Add(pt)

      Dim output_pt As point3d

      Do

        outputpoint(base_srf, pt, distance_factor, output_pt)

        output_pts.add(output_pt)

        pt = output_pt

        If output_pts.Count > 100 Then

          Exit Do

        End If

      Loop While outputpoint(base_srf, pt, distance_factor, output_pt) = True

      Dim output_crv As New PolylineCurve(output_pts)

      output_crvs.Add(output_crv)

    Next

    A = output_crvs
# ---------- flowlines: VB additional code ----------
  Private Function outputpoint(ByVal base_srf As Surface, ByVal input_pt As Point3d, ByVal distance_factor As Double, ByRef A As Object) As Boolean

    Dim u, v As Double

    base_srf.ClosestPoint(input_pt, u, v)

    Dim normal_vector As New Vector3d(base_srf.NormalAt(u, v))

    Dim translation_vector As vector3d = vector3d.CrossProduct(normal_vector, vector3d.ZAxis)

    translation_vector.Unitize

    translation_vector.Transform(Transform.Rotation(Math.PI * 0.5, normal_vector, input_pt))

    Dim moved_pt As point3d = input_pt + distance_factor * translation_vector

    base_srf.ClosestPoint(moved_pt, u, v)

    Dim output_pt As Point3d = base_srf.PointAt(u, v)

    If output_pt.Z >= input_pt.Z Then

      outputpoint = False

    Else

      outputpoint = True

    End If

    A = output_pt

  End Function
# ---------- end flowlines ----------
crv_3 = Curve(flowlines.A)
