# Grasshopper definition Color_gradient_contours.gh (Grasshopper 0.8.51)

# Right click this box and "Set Multiple Curves," then select the contours in Rhino
geo = Geometry([<20, culture=neutral, publickeytoken=null referenced from the Rhino model> x1702])
lng = ListLength(List=geo)
series = Series(Start=1, Step=1, Count=lng)
gradient = Gradient(LowerLimit=0, UpperLimit=lng, Parameter=series, stops=[0: None, 0: None, 0: None, 0: None, 0: None])
bake_with_color = BooleanToggle(True)
shader = CreateMaterial(Diffuse=gradient, Specular=RGB(255, 255, 255), Emission=RGB(0, 0, 0), Transparency=0, Shine=0)
simplebake = CSharpScript(obj=geo, layer="Gradient Contours", color=gradient, activate=bake_with_color)  # -> out; inputs obj: GeometryBase, name: String, layer: String, color: Color, activate: Boolean
# ---------- simplebake: C# ----------
    //Inserts geometry into the Rhino document, with custom attributes
    //Written by Giulio Piacentino - rewritten by [uto] for GH 07
    //Version written 2010 09 27 - for Grasshopper 0.7.0055

    if(obj == null) return;
    if(activate){

      //Make new attribute
      Rhino.DocObjects.ObjectAttributes att = new Rhino.DocObjects.ObjectAttributes();
      Guid o_id = default(Guid);

      //Set object name
      if(name != null && Rhino.DocObjects.Layer.IsValidName(name) == true)
      {
        att.Name = name;
      }

      //Set layer
      if(layer != null && Rhino.DocObjects.Layer.IsValidName(layer) == true){
        //Get the current layer index

        Rhino.DocObjects.Tables.LayerTable layerTable = doc.Layers;
        int layerIndex = layerTable.Find(layer, true);
        if(layerIndex == -1){ //This layer does not exist, we add it
          //make new layer
          Rhino.DocObjects.Layer myLayer = new Rhino.DocObjects.Layer();
          myLayer.Name = layer;
          //Add the layer to the layer table
          layerIndex = layerTable.Add(myLayer);

          if( layerIndex > -1 ){ //We manged to add layer!
            att.LayerIndex = layerIndex;
            __out.Add("Added new layer to the document at position " + layerIndex + " named " + layer + ". ");
          }else{
            __out.Add("Layer did not add. Try cleaning up your layers."); //This never happened to me.
          }
        }else{
          att.LayerIndex = layerIndex;
          __out.Add("Added to existing layer " + layerIndex + " named " + layer + ". ");
        }
      }

      //Set color
      if(color != null)
      {
        att.ColorSource = Rhino.DocObjects.ObjectColorSource.ColorFromObject;
        att.ObjectColor = color;
        att.PlotColorSource = Rhino.DocObjects.ObjectPlotColorSource.PlotColorFromObject;
        att.PlotColor = color;
      }

      //Bake to the right type of object
      switch (obj.ObjectType)
      {
        case Rhino.DocObjects.ObjectType.Brep:
          o_id = doc.Objects.AddBrep((Brep) obj, att);
          break;
        case Rhino.DocObjects.ObjectType.Mesh:
          o_id = doc.Objects.AddMesh((Mesh) obj, att);
          break;

        case Rhino.DocObjects.ObjectType.Point:
          o_id = doc.Objects.AddPoint(((Rhino.Geometry.Point) obj).Location, att);
          break;

        case Rhino.DocObjects.ObjectType.Curve:
          o_id = doc.Objects.AddCurve((Curve) obj, att);
          break;

        default:
          Print("I'm not sure what kind of geometry is coming in the input. Try turning it into a Point, Curve, Mesh, or Brep before the input.");
          return;
      }
      __out.Add("Added " + obj.GetType().Name);

    } else {

      Print("Inactive");
    }
# ---------- end simplebake ----------
preview = CustomPreview(Geometry=geo, Shader=shader)
panel = Panel(simplebake)
