# Grasshopper definition ColourBySlope.ghx (Grasshopper 0.8.66)

mesh = Mesh(<mesh referenced from the Rhino model>)
mcomp = Decompose(Mesh=mesh)  # -> Vertices, Faces, Colours, Normals
vcomp = Decompose(Vector=mcomp.Normals)  # -> XComponent, YComponent, ZComponent
f_x = F1(Function="Deg(0.0 - (Asin(Abs(z)) - 0.5*Pi))", Z=vcomp.ZComponent)
gradient = Gradient(LowerLimit=0, UpperLimit=90, Parameter=f_x, stops=[0: None, 0: None, 0: None, 0: None])
mesh_2 = Mesh(Vertices=mcomp.Vertices, Faces=mcomp.Faces, Colours=gradient)
