# Grasshopper definition Day1_XMarksTheSpot.gh (Grasshopper 0.9.14)

length = Slider(20, range=0..20)
x_input = Point([<point referenced from the Rhino model> x60])
line = LineSDL(Start=x_input, Direction=Vector(54.5880291, -54.5880291, 0), Length=length)
eval = EvaluateLength(Curve=line, Length=0.5, Normalized=True)  # -> Point, Tangent, Parameter
vec2pt = Vector2Pt(PointA=eval.Point, PointB=x_input, Unitize=False)  # -> Vector, Length
line_2 = LineSDL(Start=x_input, Direction=Vector(56.68424224, 56.68424224, 0), Length=length)
move = Move(Geometry=line, Motion=vec2pt.Vector)  # -> Geometry, Transform
eval_2 = EvaluateLength(Curve=line_2, Length=0.5, Normalized=True)  # -> Point, Tangent, Parameter
vec2pt_2 = Vector2Pt(PointA=eval_2.Point, PointB=x_input, Unitize=False)  # -> Vector, Length
move_2 = Move(Geometry=line_2, Motion=vec2pt_2.Vector)  # -> Geometry, Transform
x_output = Curve([move.Geometry, move_2.Geometry])
curve = Curve(<curve referenced from the Rhino model>)
divide_curve = DivideCurve(Curve=curve, Count=10, Kinks=False)  # -> Points, Tangents, Parameters
