# Grasshopper definition Day3_TreeImage.gh (Grasshopper 0.8.63)

# ---- group: surface from image
u_slider = Slider(47, range=0..200)
v_slider = Slider(47, range=0..200)
surface = Surface(<surface referenced from the Rhino model>)
divide_surface = DivideSurface(Surface=reparameterize(surface), UCount=u_slider, VCount=v_slider)  # -> Points, Normals, Parameters
image_sampler = ImageSampler(
    divide_surface.Parameters,
    FilePath="C:\Users\Jason Brain\Desktop\exportedlines [Converted]-01-01.jpg",
    RelativeFilePath="..\..\..\..\Desktop\exportedlines [Converted]-01-01.jpg",
    Interpolate=False,
    Wrap=1,
    Umin=0,
    Umax=1,
    Vmin=0,
    Vmax=1,
    Filter="Value")
unit_z = UnitZ(Factor=image_sampler)
move = Move(Geometry=divide_surface.Points, Motion=unit_z)  # -> Geometry, Transform
line_sdl = LineSDL(Start=divide_surface.Points, Direction=unit_z, Length=unit_z)
addition = Addition(A=u_slider, B="1")
flatten_tree = FlattenTree(Data=move.Geometry, Path="{0}")
surface_from_points = SurfaceFromPoints(Points=flatten_tree, UCount=addition, Interpolate=False)

# ---- group: inclass circles on surface from image
u_slider_2 = Slider(98, range=0..200)  # disabled
v_slider_2 = Slider(96, range=0..200)  # disabled
surface_2 = Surface()  # disabled
divide_surface_2 = DivideSurface(Surface=reparameterize(surface_2), UCount=u_slider_2, VCount=v_slider_2)  # -> Points, Normals, Parameters; disabled
image_sampler_2 = ImageSampler(
    divide_surface_2.Parameters,
    FilePath="C:\Users\Jason Brain\Dropbox\JTR - MLA Share\InClass\DAY3\Oak tree in winter.jpg",
    RelativeFilePath="..\..\..\..\Dropbox\JTR - MLA Share\InClass\DAY3\Oak tree in winter.jpg",
    Interpolate=False,
    Wrap=1,
    Umin=0,
    Umax=1,
    Vmin=0,
    Vmax=1,
    Filter="Value")  # disabled
number_slider = Slider(12.9, range=0..20)  # disabled
division = Division(A=image_sampler_2, B=number_slider)  # disabled
panel = Panel(image_sampler_2)  # disabled
circle = Circle(Plane=divide_surface_2.Points, Radius=division)  # disabled

# ---- group: vector/points from image
u_slider_3 = Slider(98, range=0..200)  # disabled
v_slider_3 = Slider(96, range=0..200)  # disabled
surface_3 = Surface()  # disabled
divide_surface_3 = DivideSurface(Surface=reparameterize(surface_3), UCount=u_slider_3, VCount=v_slider_3)  # -> Points, Normals, Parameters; disabled
image_sampler_3 = ImageSampler(
    divide_surface_3.Parameters,
    FilePath="C:\Users\Jason Brain\Desktop\exportedlines [Converted]-01-01.jpg",
    RelativeFilePath="..\..\..\..\Desktop\exportedlines [Converted]-01-01.jpg",
    Interpolate=False,
    Wrap=1,
    Umin=0,
    Umax=1,
    Vmin=0,
    Vmax=1,
    Filter="Value")  # disabled
number_slider_2 = Slider(12.9, range=0..20)  # disabled
division_2 = Division(B=number_slider_2)  # disabled
unit_z_2 = UnitZ(Factor=image_sampler_3)  # disabled
move_2 = Move(Geometry=divide_surface_3.Points, Motion=unit_z_2)  # -> Geometry, Transform; disabled
vector_display = VectorDisplay(Anchors=divide_surface_3.Points, Vectors=unit_z_2, stops=[0: None, 0: None, 0: None])  # disabled

# ---- group: inclass generated circles from image
xy_size = Slider(5, range=0..5)  # disabled
extents = Slider(100, range=0..200)  # disabled
rectangular = Rectangular(Plane=PlaneXY(0, 0, 0), SizeX=xy_size, SizeY=xy_size, ExtentX=extents, ExtentY=extents)  # -> Cells, Points; disabled
image_sampler_4 = ImageSampler(
    rectangular.Points,
    FilePath="C:\Users\Jason Brain\Dropbox\JTR - MLA Share\InClass\DAY3\Oak tree in winter.jpg",
    RelativeFilePath="..\..\..\..\Dropbox\JTR - MLA Share\InClass\DAY3\Oak tree in winter.jpg",
    Interpolate=False,
    Wrap=1,
    Umin=0,
    Umax=500,
    Vmin=0,
    Vmax=500,
    Filter="Value")  # disabled
number_slider_3 = Slider(0.6, range=0..5)  # disabled
panel_2 = Panel(image_sampler_4)  # disabled
division_3 = Division(A=image_sampler_4, B=number_slider_3)  # disabled
circle_2 = Circle(Plane=rectangular.Points, Radius=division_3)  # disabled
