# Grasshopper definition Fibonacciarray.gh (Grasshopper 0.8.63)

slider = Slider(0.008, range=0..0.05)
slider_2 = Slider(0.011, range=0..0.05)

fibonacci = Fibonacci(SeedA=Slider(0, range=-0.03..2), SeedB=Slider(1, range=0..2), Number=Slider(17, range=0..20))
series = Series(Start=0, Step=1, Count=Slider(40, range=-20..40))
power = Power(A=fibonacci, B=Slider(0.3, range=0..2))
panel = Panel(power)
curve = Curve(<curve referenced from the Rhino model>)
subtraction = Subtraction(A=power, B=Slider(0.87, range=-0.03..2))
offset = Offset(Curve=curve, Distance=subtraction, Plane=PlaneXY(0, 0, 0), Corners=1)
curve_2 = Curve(<curve referenced from the Rhino model>)
number_slider = Slider(40, range=0..40)
divide_curve = DivideCurve(Curve=offset, Count=number_slider, Kinks=False)  # -> Points, Tangents, Parameters
divide_curve_2 = DivideCurve(Curve=curve, Count=number_slider, Kinks=False)  # -> Points, Tangents, Parameters
line = Line(StartPoint=divide_curve_2.Points, EndPoint=divide_curve.Points)

fibonacci_2 = Fibonacci(SeedA=Slider(0, range=-0.03..2), SeedB=Slider(1, range=0..2), Number=Slider(17, range=0..20))
series_2 = Series(Start=0, Step=1, Count=Slider(40, range=-20..40))
power_2 = Power(A=fibonacci_2, B=Slider(0.3, range=0..2))
panel_2 = Panel(power_2)
curve_3 = Curve(<curve referenced from the Rhino model>)
subtraction_2 = Subtraction(A=power_2, B=Slider(0.85, range=-0.03..2))
offset_2 = Offset(Curve=curve_3, Distance=subtraction_2, Plane=PlaneXY(0, 0, 0), Corners=1)
curve_4 = Curve(<curve referenced from the Rhino model>)
number_slider_2 = Slider(40, range=0..40)
divide_curve_3 = DivideCurve(Curve=offset_2, Count=number_slider_2, Kinks=False)  # -> Points, Tangents, Parameters
divide_curve_4 = DivideCurve(Curve=curve_3, Count=number_slider_2, Kinks=False)  # -> Points, Tangents, Parameters
line_2 = Line(StartPoint=divide_curve_4.Points, EndPoint=divide_curve_3.Points)
