# Grasshopper definition Invasive_Basins.gh (Grasshopper 0.9.14)
# plug-ins: Kangaroo Components, PTComponentLibrary

# ---- group: Voronoi Point Disturbance
slider = Slider(83, range=0..100)  # disabled
slider_2 = Slider(1, range=0..1)  # disabled
slider_3 = Slider(86, range=0..100)  # disabled
slider_4 = Slider(15, range=0..100)  # disabled
crv = Curve(<curve referenced from the Rhino model>)  # disabled
crv_2 = Curve(<curve referenced from the Rhino model>)  # disabled
divide = DivideCurve(Curve=[crv, crv_2], Count=slider_4, Kinks=False)  # -> Points, Tangents, Parameters; disabled
sqgrid = Square(Plane=PlaneXY(0, 0, 0), Size=slider_2, ExtentX=slider, ExtentY=slider_3)  # -> Cells, Points; disabled
pt = Point()  # disabled
slider_5 = Slider(43.2, range=0..50)  # disabled
dist = Distance(PointA=sqgrid.Points, PointB=divide.Points)  # disabled
flatten = FlattenTree(Data=sqgrid.Points, Path="{0}")  # disabled
panel = Panel("Max (x)")  # disabled
bnd = Bounds2D(Coordinates=flatten)  # disabled
eval = Evaluate(F=panel, x=dist)  # disabled
dom = Domain²Components(Domain=bnd)  # -> UComponent, VComponent; disabled
box = IntervalBox(Base=PlaneXY(0, 0, 0), X=dom.UComponent, Y=dom.VComponent, Z=Domain(0, 1))  # disabled
division = Division(A=slider_5, B=eval)  # disabled
larger = LargerThan(FirstNumber=dist, SecondNumber=division)  # -> LargerThan, OrEqualTo; disabled
dispatch = Dispatch(List=dist, DispatchPattern=larger.LargerThan)  # -> ListA, ListB; disabled
dispatch_2 = Dispatch(List=sqgrid.Points, DispatchPattern=larger.LargerThan)  # -> ListA, ListB; disabled
vec2pt = Vector2Pt(PointA=sqgrid.Points, PointB=dispatch_2.ListB, Unitize=False)  # -> Vector, Length; disabled
amp = Amplitude(Vector=vec2pt.Vector, Amplitude=dispatch.ListB)  # disabled
move = Move(Geometry=dispatch_2.ListB, Motion=amp)  # -> Geometry, Transform; disabled
cull = CullNth(List=move.Geometry, CullFrequency=2)  # disabled
slider_6 = Slider(9.1, range=0..30)  # disabled
slider_7 = Slider(50, range=0..50)  # disabled
lng = ListLength(List=cull)  # disabled
random = Random(Range=slider_6, Number=expr("N*2", lng), Seed=slider_7)  # disabled
dispatch_3 = Dispatch(List=random, DispatchPattern=[True, False])  # -> ListA, ListB; disabled
vec = VectorXYZ(XComponent=dispatch_3.ListA, YComponent=dispatch_3.ListB, ZComponent=0)  # -> Vector, Length; disabled
move_2 = Move(Geometry=cull, Motion=vec.Vector)  # -> Geometry, Transform; disabled
flatten_2 = FlattenTree(Data=move_2.Geometry, Path="{0}")  # disabled
voronoi = Voronoi(Points=flatten_2, Box=box, Plane=PlaneXY(0, 0, 0), BruteForceOverride=False)  # disabled
crv_3 = Curve(voronoi)  # disabled

# ---- group: Voronoi Basic
slider_8 = Slider(18, range=0..100)  # disabled
slider_9 = Slider(51, range=0..100)  # disabled
slider_10 = Slider(68, range=0..100)  # disabled
slider_11 = Slider(15, range=0..100)  # disabled
ptplanar = PlanarGrid(
    BasePoint=Point(0, 0, 0),
    IDir=Vector(1, 0, 0),
    JDir=Vector(0, 1, 0),
    IDistance=slider_11,
    JDistance=slider_8,
    INumber=slider_10,
    JNumber=slider_9)  # disabled
slider_12 = Slider(3.676, range=0..5)  # disabled
crv_4 = Curve(<curve referenced from the Rhino model>)  # disabled
crv_5 = Curve(<curve referenced from the Rhino model>)  # disabled
ptcrvatts = CurveAttraction(Grid=ptplanar, CrvAtts=[crv_4, crv_5], Magnitude=slider_12)  # -> Grid, Weights; disabled
slider_13 = Slider(16, range=0..100)  # disabled
pt_2 = Point([<point referenced from the Rhino model> x15])  # disabled
voronoi_2 = Voronoi(Points=pt_2, Plane=PlaneXY(0, 0, 0), BruteForceOverride=False)  # disabled
divide_2 = DivideCurve(Curve=voronoi_2, Count=slider_13, Kinks=False)  # -> Points, Tangents, Parameters; disabled
toggle = BooleanToggle(True)  # disabled
slider_14 = Slider(-32, range=-100..100)  # disabled
crv_6 = Curve(Vertices=divide_2.Points, Degree=3, Periodic=toggle)  # -> Curve, Length, Domain; disabled
planar = PlanarSrf(Edges=voronoi_2)  # disabled
offset = Offset(Curve=crv_6.Curve, Distance=slider_14, Plane=PlaneXY(0, 0, 0), Corners=1)  # disabled
flatten_3 = FlattenTree(Data=offset, Path="{0}")  # disabled
srfsplit = SurfaceSplit(Surface=planar, Curves=flatten_3)  # disabled
item = ListItem(List=srfsplit, Index=0, Wrap=False)  # disabled

# ---- group: Enhanced Voronoi Fillet
slider_15 = Slider(1, range=0..100)  # disabled
slider_16 = Slider(40, range=0..100)  # disabled
slider_17 = Slider(40, range=0..100)  # disabled
slider_18 = Slider(1, range=0..100)  # disabled
ptplanar_2 = PlanarGrid(
    BasePoint=Point(0, 0, 0),
    IDir=Vector(1, 0, 0),
    JDir=Vector(0, 1, 0),
    IDistance=slider_18,
    JDistance=slider_15,
    INumber=slider_17,
    JNumber=slider_16)  # disabled
slider_19 = Slider(2.876, range=0..5)  # disabled
crv_7 = Curve(<curve referenced from the Rhino model>)  # disabled
crv_8 = Curve(<curve referenced from the Rhino model>)  # disabled
ptcrvatts_2 = CurveAttraction(Grid=ptplanar_2, CrvAtts=[crv_7, crv_8], Magnitude=slider_19)  # -> Grid, Weights; disabled
bbox = BoundingBox(Content=ptcrvatts_2.Grid, Plane=PlaneXY(0, 0, 0))  # -> Box, Box_2; disabled
Z = UnitZ(Factor=1)  # disabled
extr = Extrude(Base=bbox.Box, Direction=Z)  # disabled
voronoi_3 = Voronoi(Points=ptcrvatts_2.Grid, Box=extr, Plane=PlaneXY(0, 0, 0), BruteForceOverride=False)  # disabled
explode = Explode(Curve=voronoi_3, Recursive=True)  # -> Segments, Vertices; disabled
cull_i = CullIndex(List=explode.Vertices, Indices=0, Wrap=False)  # disabled
avr = Average(Input=cull_i)  # disabled
slider_20 = Slider(7.351, range=0..10.5)  # disabled
extr_2 = ExtrudePoint(Base=explode.Segments, Point=graft(avr))  # disabled
area = Area(Geometry=extr_2)  # -> Area, Centroid; disabled
fillet = FilletDistance(Curve=extr_2, Distance=slider_20)  # disabled
scale = Scale(Geometry=fillet, Center=area.Centroid, Factor=0.5)  # -> Geometry, Transform; disabled

# ---- group: Voronoi Curve
slider_21 = Slider(0.97, range=0..1)  # disabled
slider_22 = Slider(100, range=0..100)  # disabled
tolerance = Slider(1.274, range=0..5)  # disabled
recgrid = Rectangular(Plane=PlaneXY(0, 0, 0), SizeX=slider_21, SizeY=slider_21, ExtentX=slider_22, ExtentY=slider_22)  # -> Cells, Points; disabled
crv_9 = Curve(<curve referenced from the Rhino model>)  # disabled
crv_cp = CurveCP(Point=recgrid.Points, Curve=crv_9)  # -> Point, Parameter, Distance; disabled
slider_23 = Slider(0.525, range=0..6)  # disabled
slider_24 = Slider(1.125, range=0..6)  # disabled
larger_2 = LargerThan(FirstNumber=crv_cp.Distance, SecondNumber=tolerance)  # -> LargerThan, OrEqualTo; disabled
slider_25 = Slider(5, range=0..40)  # disabled
slider_26 = Slider(3, range=1..16)  # disabled
dispatch_4 = Dispatch(List=recgrid.Points, DispatchPattern=larger_2.OrEqualTo)  # -> ListA, ListB; disabled
prox = Proximity2D(Points=flatten(dispatch_4.ListB), Plane=PlaneXY(0, 0, 0), Group=slider_26, MaxRadius=slider_25)  # -> Links, Topology; disabled
circle = CircleCNR(Center=dispatch_4.ListB, Normal=Vector(0, 0, 1), Radius=0.25)  # disabled
rectangle = Rectangle(Plane=dispatch_4.ListA, XSize=slider_24, YSize=slider_23, Radius=0)  # -> Rectangle, Length; disabled
cells = Slider(9, range=0..42)  # disabled
voronoi_4 = Voronoi(
    Points=flatten(dispatch_4.ListB),
    Box={Plane=Plane(origin=(-0.1470923256, -0.09502421145, 0), x=(0, 1, 0), y=(1, 0, 0)), X=Domain(0, 10.00484449), Y=Domain(0, 10.06422042), Z=Domain(-2.033391189, 0)},
    Plane=PlaneXY(0, 0, 0),
    BruteForceOverride=False)  # disabled
crv_10 = Curve(prox.Links)  # disabled
slider_27 = Slider(0.61, range=0..1)  # disabled
item_2 = ListItem(List=voronoi_4, Index=cells, Wrap=False)  # disabled
con = Containment(Point=dispatch_4.ListA, Curve=item_2)  # -> Relationship, Point; disabled
panel_2 = Panel("1")  # disabled
area_2 = Area(Geometry=voronoi_4)  # -> Area, Centroid; disabled
smaller = SmallerThan(FirstNumber=con.Relationship, SecondNumber=panel_2)  # -> SmallerThan, OrEqualTo; disabled
scale_2 = Scale(Geometry=voronoi_4, Center=area_2.Centroid, Factor=slider_27)  # -> Geometry, Transform; disabled
dispatch_5 = Dispatch(List=con.Point, DispatchPattern=smaller.OrEqualTo)  # -> ListA, ListB; disabled
pt_3 = Point(dispatch_5.ListA)  # disabled

# ---- group: Mesh Circle Packing
mesh = Mesh()  # disabled
mcomp = Decompose(Mesh=mesh)  # -> Vertices, Faces, Colours, Normals; disabled
medges = MeshEdges(Mesh=mesh)  # -> NakedEdges, InteriorEdges, NonManifoldEdges; disabled
lng_2 = ListLength(List=mcomp.Vertices)  # disabled
series = Series(Start=0, Step=1, Count=lng_2)  # disabled
line = Line([medges.NakedEdges, medges.InteriorEdges])  # disabled
vn = VertexNeighbours(Mesh=mesh, VertexNumber=series)  # -> graft(Vertex), Neighbours, Normal; disabled
end = EndPoints(Curve=line)  # -> Start, End; disabled
eval_2 = EvaluateCurve(Curve=reparameterize(line), Parameter=0.5)  # -> Point, Tangent, Angle; disabled
ln = Line(StartPoint=vn.Vertex, EndPoint=vn.Neighbours)  # disabled
eval_3 = EvaluateCurve(Curve=reparameterize(ln), Parameter=0.5)  # -> Point, Tangent, Angle; disabled
bend = Bend(Point1=end.Start, Point2=eval_2.Point, Point3=end.End, BendStrength=2000, RestAngle=0)  # disabled
ln_2 = Line(StartPoint=vn.Vertex, EndPoint=eval_3.Point)  # disabled
line_2 = Line(ln_2)  # disabled
equalizen = EqualizeN(Lines=line_2, EqNStrength=1000)  # disabled
springs = SpringsFromLine(Connection=line_2, Stiffness=0.01, Damping=10, RestLength=line_2, UpperCutoff=0, LowerCutoff=0, Plasticity=0)  # disabled
toggle_2 = BooleanToggle(True)  # disabled
kangaroo = KangarooPhysics(ForceObjects=flatten([springs, equalizen, bend]), Settings=null, Geometry=line_2, SimulationReset=toggle_2)  # -> Out, Iterations, ParticlesOut, GeometryOut; disabled
timer = Timer(TimerInterval=5, Target=kangaroo)  # disabled
lng_3 = ListLength(List=kangaroo.GeometryOut)  # disabled
crv_11 = Curve(kangaroo.GeometryOut)  # disabled
larger_3 = LargerThan(FirstNumber=lng_3, SecondNumber=2)  # -> LargerThan, OrEqualTo; disabled
cull_2 = CullPattern(List=kangaroo.GeometryOut, CullPattern=larger_3.LargerThan)  # disabled
clean = CleanTree(Data=cull_2, CleanInvalid=True, CleanEmpty=True)  # disabled
end_2 = EndPoints(Curve=clean)  # -> Start, End; disabled
fcircle = CircleFit(Points=end_2.End)  # -> Circle, Radius, Deviation; disabled

# ---- group: Diamond Attraction
slider_28 = Slider(13, range=0..50)  # disabled
srf = Surface(<surface referenced from the Rhino model>)  # disabled
ptsrfdomnum = SurfaceDomainNumber(Surface=srf, UNumber=slider_28, VNumber=slider_28)  # disabled
slider_29 = Slider(2.23, range=-50..50)  # disabled
crv_12 = Curve(<curve referenced from the Rhino model>)  # disabled
slider_30 = Slider(5.8, range=0..10)  # disabled
xy = XYPlane(Origin=Point(0, 0, 0))  # disabled
panel_3 = Panel("0")  # disabled
ptcrvatts_3 = CurveAttraction(Grid=ptsrfdomnum, CrvAtts=crv_12, Magnitude=slider_29)  # -> Grid, Weights; disabled
ptborders = GenerateBorders(Grid=ptcrvatts_3.Grid, PanelShape=panel_3)  # disabled
rectangle_2 = Rectangle(Plane=xy, XSize=slider_30, YSize=slider_30, Radius=0)  # -> Rectangle, Length; disabled
explode_2 = Explode(Curve=ptborders, Recursive=rectangle_2.Rectangle)  # -> Segments, Vertices; disabled
curvepoint = PointOnCurve(explode_2.Segments, parameter=0.498)  # disabled
toggle_3 = BooleanToggle(True)  # disabled
pline = PolyLine(Vertices=curvepoint, Closed=toggle_3)  # disabled
slider_31 = Slider(0.59, range=0..1)  # disabled
area_3 = Area(Geometry=pline)  # -> Area, Centroid; disabled
scale_nu = ScaleNU(Geometry=pline, Plane=area_3.Centroid, ScaleX=slider_31, ScaleY=1, ScaleZ=1)  # -> Geometry, Transform; disabled

# ---- group: Basic Voronoi Fillet
slider_32 = Slider(18, range=0..100)  # disabled
slider_33 = Slider(51, range=0..100)  # disabled
slider_34 = Slider(68, range=0..100)  # disabled
slider_35 = Slider(15, range=0..100)  # disabled
ptplanar_3 = PlanarGrid(
    BasePoint=Point(0, 0, 0),
    IDir=Vector(1, 0, 0),
    JDir=Vector(0, 1, 0),
    IDistance=slider_35,
    JDistance=slider_32,
    INumber=slider_34,
    JNumber=slider_33)  # disabled
slider_36 = Slider(3.676, range=0..5)  # disabled
crv_13 = Curve(<curve referenced from the Rhino model>)  # disabled
crv_14 = Curve(<curve referenced from the Rhino model>)  # disabled
ptcrvatts_4 = CurveAttraction(Grid=ptplanar_3, CrvAtts=[crv_13, crv_14], Magnitude=slider_36)  # -> Grid, Weights; disabled
voronoi_5 = Voronoi(Points=ptcrvatts_4.Grid, Plane=PlaneXY(0, 0, 0), BruteForceOverride=False)  # disabled
slider_37 = Slider(0.72, range=0..1)  # disabled
pcen = PolygonCenter(Polyline=voronoi_5)  # -> CenterV, CenterE; disabled
scale_3 = Scale(Geometry=voronoi_5, Center=pcen.CenterV, Factor=slider_37)  # -> Geometry, Transform; disabled
slider_38 = Slider(5, range=0..5)  # disabled
fillet_2 = Fillet(Curve=scale_3.Geometry, Radius=slider_38)  # disabled

# ---- group: Paneling Projection
projection_surface = Surface(<surface referenced from the Rhino model>)  # disabled
base_surface = Surface(<surface referenced from the Rhino model>)  # disabled
crv_15 = Curve([<curve referenced from the Rhino model> x5])  # disabled
brep = Brep(<brep referenced from the Rhino model>)  # disabled
slider_39 = Slider(98, range=0..100)  # disabled
slider_40 = Slider(23, range=0..50)  # disabled
slider_41 = Slider(4, range=0..20)  # disabled
ptsrfdomnum_2 = SurfaceDomainNumber(Surface=base_surface, UNumber=slider_39, VNumber=slider_40)  # disabled
bbox_2 = BoundingBox(Content=brep, Plane=PlaneXY(0, 0, 0))  # -> Box, Box_2; disabled
ptcrvatts_5 = CurveAttraction(Grid=ptsrfdomnum_2, CrvAtts=crv_15, Magnitude=slider_41)  # -> Grid, Weights; disabled
Z_2 = UnitZ(Factor=1)  # disabled
pt_4 = Point(ptcrvatts_5.Grid)  # disabled
project = ProjectPoint(Point=pt_4, Direction=Z_2, Geometry=projection_surface)  # -> Point, Index; disabled
ptmorph3d = Morph3D(
    Grid1=ptcrvatts_5.Grid,
    Grid2=project.Point,
    PatternObjects=brep,
    BoundingObjects=bbox_2.Box,
    Shift_i=1,
    Shift_j=1,
    Pull=False)  # disabled
points = PointList(Points=project.Point, Tags=True, Lines=True)  # disabled
