# Grasshopper definition Irregular_Paneling.gh (Grasshopper 0.9.14)

# ---- group: Irregular Paneling 1
slider = Slider(21, range=0..50)
range = Range(Domain=Domain(0, 1), Steps=slider)
range_2 = Range(Domain=Domain(0, 1), Steps=slider)
srf = Surface(<surface referenced from the Rhino model>)
graph = GraphMapper(range_2, x0=0, x1=1, y0=0, y1=1, container_name="Power", power=1.290373827, Gx=0.5579710007, Gy=0.4710144997)
graph_2 = GraphMapper(
    range,
    x0=0,
    x1=1,
    y0=0,
    y1=1,
    container_name="Bezier",
    cpx=[0, 0.4637681246, 0.4057970941, 1],
    cpy=[0, 0.1956521869, 0.9057971239, 1])
dom = Domain²Components(Domain=srf)  # -> UMin, UMax, VMin, VMax
multiplication = Multiplication(A=graph_2, B=dom.UMax)
multiplication_2 = Multiplication(A=graph, B=dom.VMax)
divide = DivideDomain²(Domain=srf, UCount=10, VCount=10)
shift = ShiftList(List=multiplication, Shift=1, Wrap=False)
shift_2 = ShiftList(List=multiplication_2, Shift=1, Wrap=False)
dom_2 = Domain(DomainStart=multiplication, DomainEnd=shift)
dom_3 = Domain(DomainStart=multiplication_2, DomainEnd=shift_2)
lng = ListLength(List=dom_2)
lng_2 = ListLength(List=dom_3)
culln = CullNth(List=dom_2, CullFrequency=lng)
culln_2 = CullNth(List=dom_3, CullFrequency=lng_2)
dom² = Domain²(DomainU=graft(culln), DomainV=culln_2)
subsrf = Isotrim(Surface=srf, Domain=dom²)
area = Area(Geometry=subsrf)  # -> Area, Centroid

# ---- group: Culling Grid
crv = Curve(<curve referenced from the Rhino model>)
series = Series(Start=0, Step=Slider(6, range=0..50), Count=Slider(18, range=0..50))
X = UnitX(Factor=series)
move = Move(Geometry=crv, Motion=X)  # -> Geometry, Transform
cull = CullPattern(List=move.Geometry, CullPattern=[False, False, True, True])
shift_3 = ShiftList(List=cull, Shift=1, Wrap=False)
edgesrf = EdgeSurface(CurveA=cull, CurveB=shift_3)  # -> graft(Surface)
divide_2 = DivideDomain²(Domain=edgesrf, UCount=1, VCount=Slider(14, range=0..50))
subsrf_2 = Isotrim(Surface=edgesrf, Domain=divide_2)  # -> flatten(Surface)

# ----
slider_2 = Slider(21, range=0..50)
pt = Point([<point referenced from the Rhino model> x100])

# ---- group: Simple Iso Pipe
slider_3 = Slider(0, range=0..1)  # disabled
srf_2 = Surface(<surface referenced from the Rhino model>)  # disabled
slider_4 = Slider(0.411, range=0..1)  # disabled
wires = BrepWireframe(Brep=srf_2, Density=slider_3)  # disabled
pipe = Pipe(Curve=wires, Radius=slider_4, Caps=0)  # disabled

# ---- group: Simple Delaunay Pipe
pt_2 = Point([<point referenced from the Rhino model> x100])  # disabled
con = DelaunayEdges(Points=pt_2, Plane=PlaneXY(0, 0, 0))  # -> Connectivity, Edges; disabled
slider_5 = Slider(0.292, range=0..1)  # disabled
pipe_2 = Pipe(Curve=con.Edges, Radius=slider_5, Caps=0)  # disabled

# ----
pt2num = PointsToNumbers(Points=pt, Mask=4)
panel = Panel(pt2num)
range_3 = Range(Domain=Domain(0, 1), Steps=slider_2)
range_4 = Range(Domain=Domain(0, 1), Steps=slider_2)
srf_3 = Surface(<surface referenced from the Rhino model>)
lng_3 = ListLength(List=pt2num)
graph_3 = GraphMapper(range_4, x0=0, x1=1, y0=0, y1=1, container_name="Power", power=1.290373827, Gx=0.5579710007, Gy=0.4710144997)
series_2 = Series(Start=0, Step=1, Count=lng_3)
graph_4 = GraphMapper(
    range_3,
    x0=0,
    x1=1,
    y0=0,
    y1=1,
    container_name="Bezier",
    cpx=[0, 0.4637681246, 0.4057970941, 1],
    cpy=[0, 0.1956521869, 0.9057971239, 1])
dom_4 = Domain²Components(Domain=srf_3)  # -> UMin, UMax, VMin, VMax
reduce = RandomReduce(List=series_2, Reduction=Slider(11, range=0..50), Seed=1)
lng_4 = ListLength(List=reduce)
random = Random(Range=Domain(0, 1), Number=lng_4, Seed=2)
multiplication_3 = Multiplication(A=graph_4, B=dom_4.UMax)
multiplication_4 = Multiplication(A=graph_3, B=dom_4.VMax)
sort = SortList(Keys=random, ValuesA=reduce)  # -> Keys, ValuesA
divide_3 = DivideDomain²(Domain=srf_3, UCount=10, VCount=10)
shift_4 = ShiftList(List=multiplication_3, Shift=1, Wrap=False)
panel_2 = Panel(sort.ValuesA)
shift_5 = ShiftList(List=multiplication_4, Shift=1, Wrap=False)
pt_3 = PointXYZ(XComponent=0, YComponent=0, ZComponent=0, System=PlaneXY(0, 0, 0))
dom_5 = Domain(DomainStart=multiplication_3, DomainEnd=shift_4)
dom_6 = Domain(DomainStart=multiplication_4, DomainEnd=shift_5)
lng_5 = ListLength(List=dom_5)
lng_6 = ListLength(List=dom_6)
culln_3 = CullNth(List=dom_5, CullFrequency=lng_5)
con_2 = DelaunayEdges(Plane=PlaneXY(0, 0, 0))  # -> Connectivity, Edges
culln_4 = CullNth(List=dom_6, CullFrequency=lng_6)
dom²_2 = Domain²(DomainU=graft(culln_3), DomainV=culln_4)
subsrf_3 = Isotrim(Surface=srf_3, Domain=dom²_2)
area_2 = Area(Geometry=subsrf_3)  # -> Area, Centroid
pipe_3 = Pipe(Curve=con_2.Edges, Radius=Slider(0.292, range=0..1), Caps=0)
