# Grasshopper definition Paneling_101.gh (Grasshopper 0.9.14)
# plug-ins: PTComponentLibrary

# ---- group: Paneling Mechanics (Not For Use)
slider = Slider(11, range=0..100)
ptplanar = PlanarGrid(
    BasePoint=Point(0, 0, 0),
    IDir=Vector(1, 0, 0),
    JDir=Vector(0, 1, 0),
    IDistance=1,
    JDistance=1.5,
    INumber=Slider(25, range=0..100),
    JNumber=Slider(25, range=0..100))
ptrow = ExtractRow(Grid=ptplanar, Row=slider)
Z = UnitZ(Factor=Slider(6, range=0..100))
ptcol = ExtractColumn(Grid=ptplanar, Col=Slider(6, range=0..100))
ptitem = ExtractItem(Grid=ptplanar, Row=Slider(10, range=0..100), Column=Slider(9, range=0..100))
move = Move(Geometry=ptrow, Motion=Z)  # -> Geometry, Transform
ptindices = ExtractGridIndices(Grid=ptplanar)  # -> I_Indices, J_Indices
lng = ListLength(List=move.Geometry)
concat = Concatenate(A=ptindices.I_Indices, B=ptindices.J_Indices)
series = Series(Start=0, Step=1, Count=lng)
ptreplace = Replace(Grid=ptplanar, Items=move.Geometry, Row=slider, Column=series)
ptgridsrf = SurfaceFromGrid(Grid=ptreplace, Through=False)
tag = TextTag3D(Location=ptreplace, Text=concat, Size=Slider(0.25, range=0..1))
panel = Panel(series)

# ---- group: Basic Paneling
initial_base_surface = Surface(<surface referenced from the Rhino model>)
offset = Offset(Surface=initial_base_surface, Distance=Slider(1, range=0..25), Retrim=True)
ptsrfdomnum = SurfaceDomainNumber(Surface=offset, UNumber=10, VNumber=10)
ptsrfdomnum_2 = SurfaceDomainNumber(Surface=initial_base_surface, UNumber=10, VNumber=10)
assigned_module = Brep(<brep referenced from the Rhino model>)
ptcell = Cellulate(Grid=ptsrfdomnum_2)  # -> Wires, Cells, Meshes
ptmorph3d = Morph3D(Grid1=ptsrfdomnum_2, Grid2=ptsrfdomnum, PatternObjects=assigned_module, Shift_i=1, Shift_j=1, Pull=False)

# ---- group: Paneling Curves (Boring!)
crv = Curve([<curve referenced from the Rhino model> x2])  # disabled
ptmorph2d = Morph2D(Grid=ptsrfdomnum_2, PatternCurves=crv, Shift_i=1, Shift_j=1)  # disabled
