# Grasshopper definition Polderizer_V1.gh (Grasshopper 0.9.14)

srf = Surface(<surface referenced from the Rhino model>)
geo = Geometry(<brep referenced from the Rhino model>)
geo_2 = Geometry(<brep referenced from the Rhino model>)
divide = DivideDomain²(Domain=srf, UCount=Slider(21, range=0..50), VCount=Slider(26, range=0..50))
subsrf = Isotrim(Surface=srf, Domain=divide)
bbox = BoundingBox(Plane=PlaneXY(0, 0, 0))  # -> Box, Box_2
bbox_2 = BoundingBox(Content=geo, Plane=PlaneXY(0, 0, 0))  # -> Box, Box_2
sbox = SurfaceBox(Surface=subsrf, Domain=divide, Height=1)
morph = BoxMorph(Geometry=geo, Reference=bbox_2.Box)
