# Grasshopper definition SpotElevations.gh (Grasshopper 0.8.66)

panel = Panel("DIVIDE SURFACE")
surface_input_brep_or_srf = Brep(<brep referenced from the Rhino model>)
divisions = Slider(11, range=0..100)
sdivide = DivideSurface(Surface=surface_input_brep_or_srf, UCount=divisions, VCount=divisions)  # -> Points, Normals, Parameters
panel_2 = Panel("GET Z VALUES")
pcomp = Decompose(Point=sdivide.Points, System=PlaneXY(0, 0, 0))  # -> XComponent, YComponent, ZComponent
# FLATTEN TEXT ON Z (OPTIONAL)
fixed_z_for_text = Slider(0, range=0..100)
panel_3 = Panel("TRUNCATE")
pt = PointXYZ(XComponent=pcomp.XComponent, YComponent=pcomp.YComponent, ZComponent=fixed_z_for_text, System=PlaneXY(0, 0, 0))
f_x = F1(Function="Format(\"{0:0.00}\",x)", X=pcomp.ZComponent)
panel_4 = Panel("POINTS FOR TEXT")
rad = Radians(Degrees=Slider(1, range=0..1))
cir = Circle(Plane=pt, Radius=Slider(20, range=0..20))
text_size = Slider(52.9, range=0..100)
Y = UnitY(Factor=1)
panel_5 = Panel("DISPLAY TEXT")
rot3d = Rotate3D(Geometry=pt, Angle=rad, Center=pt, Axis=Y)  # -> Geometry, Transform
tag = TextTag3D(Location=rot3d.Geometry, Text=f_x, Size=text_size)
