# Grasshopper definition Trees_GridRandomlyReduced.ghx (Grasshopper 0.8.51)

# ---- group: Create a grid of points
of_x_points = Slider(110, range=0..200)
of_y_points = Slider(38, range=0..200)
# In Rhino, create a point at the lower right hand corner of the mesh you wish to add trees to. Right click on the Pt button and Select One Point to the point you just created.
base_point = Point(<point referenced from the Rhino model>)
# Adjust these sliders to adjust the size and spacing of the grid.
grid_spacing = Slider(9, range=0..20)
pcomp = Decompose(Point=base_point)  # -> XComponent, YComponent, ZComponent
series_x = Series(Start=pcomp.XComponent, Step=grid_spacing, Count=of_x_points)
series_y = Series(Start=pcomp.YComponent, Step=grid_spacing, Count=of_y_points)
pt = PointXYZ(XComponent=series_x, YComponent=series_y, ZComponent=0, DataComparison="cross_reference")

# ---- group: Randomly reduce the number of points
of_points_to_remove = Slider(1498, range=0..3000)
# Adjust these sliders to change the number of points that are removed.
random_seed = Slider(407, range=0..3000)
randomly_reduce_points = RandomReduce(List=pt, Reduction=of_points_to_remove, Seed=random_seed)

# ---- group: Intersect mesh with points
# Right click the Mesh button and Select One Mesh, in Rhino select the mesh you wish to add a randomly reduced grid of trees to.
mesh = Mesh(<mesh referenced from the Rhino model>)
Z = UnitZ(Factor=1)
meshray = MeshRay(Mesh=mesh, Point=randomly_reduce_points, Direction=Z)  # -> Point, Hit

# ---- group: Create trees at intersection points
# Adjust these sliders to change the of the trees' trunks and canopy.
canopy_radius = Slider(3, range=0..20)
trunk_radius = Slider(0.678, range=0..3)
trunk_height = Slider(6, range=0..20)
pl = PlaneNormal(Origin=meshray.Point, ZAxis=Vector(0, 0, 1))
Z_2 = UnitZ(Factor=trunk_height)
cyl = Cylinder(Base=pl, Radius=trunk_radius, Length=trunk_height)
move = Move(Geometry=pl, Translation=Z_2)
sph = Sphere(Base=move, Radius=canopy_radius)
