# Grasshopper definition Trees_RandomScattering_rev.ghx (Grasshopper 0.9.14)

# ---- group: Create a grid of points
of_x_points = Slider(110, range=0..200)
of_y_points = Slider(170, range=0..200)
# In Rhino, create a point at the lower right hand corner of the mesh you wish to add trees to. Right click on the Pt button and Select One Point to the point you just created.
base_point = Point(Point(3087.414464, 2225.881909, 0))
# Adjust these sliders to adjust the size and spacing of the grid.
grid_spacing = Slider(25, range=0..100)
pcomp = Decompose(Point=base_point)  # -> XComponent, YComponent, ZComponent
series_x = Series(Start=pcomp.XComponent, Step=grid_spacing, Count=of_x_points)
series_y = Series(Start=pcomp.YComponent, Step=grid_spacing, Count=of_y_points)
pt = PointXYZ(XComponent=series_x, YComponent=series_y, ZComponent=0, DataComparison="cross_reference")

# ---- group: Randomly move points to create a scattering
# Adjust these sliders to change the maximum amount the points are randomly moved from their original position.
amount_to_move = Slider(-60, range=-100..0)
amount_to_move_2 = Slider(60, range=0..100)
random_seed = Slider(500, range=0..3000)
dom = Domain(DomainStart=amount_to_move, DomainEnd=amount_to_move_2)
lng = ListLength(List=pt)
random = Random(Range=dom, Number=lng, Seed=random_seed, Integers=False)
jitter = Jitter(List=random, Jitter=1, Seed=2)  # -> Range, Indices
X = UnitX(Factor=random)
Y = UnitY(Factor=jitter.Range)
move_x = Move(Geometry=pt, Translation=X)
move_y = Move(Geometry=move_x, Translation=Y)

# ---- group: Intersect points with mesh
# Right click the Mesh button and Select One Mesh, in Rhino select the mesh you wish to add a randomly reduced grid of trees to.
mesh = Mesh(<mesh referenced from the Rhino model>)
Z = UnitZ(Factor=1)
meshray = MeshRay(Mesh=mesh, Point=move_y, Direction=Z)  # -> Point, Hit

# ---- group: Create trees at intersection points
pl = PlaneNormal(Origin=meshray.Point, ZAxis=Vector(0, 0, 1))
# Adjust these sliders to change the size of the trees' trunks and canopy.
canopy_radius = Slider(10, range=0..20)
trunk_radius = Slider(0.678, range=0..3)
trunk_height = Slider(6, range=0..20)
Z_2 = UnitZ(Factor=trunk_height)
cyl = Cylinder(Base=pl, Radius=trunk_radius, Length=trunk_height)  # disabled
move = Move(Geometry=pl, Translation=Z_2)
sph = Sphere(Base=move, Radius=canopy_radius)  # disabled

# ----
cir = Circle(Plane=move, Radius=canopy_radius)
