# Grasshopper definition Trees_RectGrid.ghx (Grasshopper 0.8.51)

# In Rhino, create a point at the lower right hand corner of the mesh you wish to add trees to. Right click on the Pt button and Select One Point to the point you just created.
pt = Point(<point referenced from the Rhino model>)

# ---- group: Point grid
grid_spacing = Slider(38, range=0..50)
of_x_cells = Slider(108, range=0..200)
# Adjust these sliders to adjust the size and spacing of the grid.
of_y_cells = Slider(40, range=0..200)
sqgrid = Square(Plane=pt, Size=grid_spacing, ExtentX=of_x_cells, ExtentY=of_y_cells)  # -> Cells, Points

# ---- group: Intersect points with mesh
Z = UnitZ(Factor=1)
# Right click the Mesh button and Select One Mesh, in Rhino select the mesh you wish to add a grid of trees to.
mesh = Mesh(<mesh referenced from the Rhino model>)
meshray = MeshRay(Mesh=mesh, Point=sqgrid.Points, Direction=Z)  # -> Point, Hit

# ---- group: Create trees at intersection points
pl = PlaneNormal(Origin=meshray.Point, ZAxis=Vector(0, 0, 1))
# Adjust these sliders to change the of the trees' trunks and canopy.
canopy_radius = Slider(8, range=0..20)
trunk_radius = Slider(0.678, range=0..3)
trunk_height = Slider(11, range=0..20)
Z_2 = UnitZ(Factor=trunk_height)
cyl = Cylinder(Base=pl, Radius=trunk_radius, Length=trunk_height)
move = Move(Geometry=pl, Translation=Z_2)
sph = Sphere(Base=move, Radius=canopy_radius)
