# Grasshopper definition Week 3 - Manipulating Terrain (multiple images).gh (Grasshopper 0.9.6)

# ----
# Make sure the Starting Mesh is close to the origin point (0,0,0), and that one of the corner points has a Z-value of 0. The imported contours from GIS (and hence the RhinoTerrain mesh) may be offset by tens of thousands of meters, and will likely have to be moved.
# Part 2: Grid of points under DEM mesh
cell_size_resolution = Slider(100, range=0..1000)
starting_mesh = Mesh(<mesh referenced from the Rhino model>)

# ----
# Creates a 3D bounding box around the original mesh, uses the corner points of the bounding box to determine the length and width of the mesh on the XY plane, and projects a square grid with the same proportions as the original mesh.
bbox = BoundingBox(Content=starting_mesh, Plane=PlaneXY(0, 0, 0))  # -> Box, Box_2
box_corners = BoxCorners(Box=bbox.Box)  # -> CornerA, CornerB, CornerC, CornerD, CornerE, CornerF, CornerG, CornerH
pcomp = Decompose(Point=box_corners.CornerA, System=PlaneXY(0, 0, 0))  # -> XComponent, YComponent, ZComponent
pcomp_2 = Decompose(Point=box_corners.CornerB, System=PlaneXY(0, 0, 0))  # -> XComponent, YComponent, ZComponent
pcomp_3 = Decompose(Point=box_corners.CornerC, System=PlaneXY(0, 0, 0))  # -> XComponent, YComponent, ZComponent
subtraction = Subtraction(A=pcomp_2.XComponent, B=pcomp.XComponent)
subtraction_2 = Subtraction(A=pcomp_3.YComponent, B=pcomp_2.YComponent)
integer_division = IntegerDivision(A=subtraction, B=cell_size_resolution)
integer_division_2 = IntegerDivision(A=subtraction_2, B=cell_size_resolution)
sqgrid = Square(Plane=box_corners.CornerA, Size=cell_size_resolution, ExtentX=integer_division, ExtentY=integer_division_2)  # -> Cells, flatten(Points)

A = Point(box_corners.CornerA)
B = Point(box_corners.CornerB)
C = Point(box_corners.CornerC)

# ----
# Intersects original DEM mesh with XY grid points. The intersection points will be used to rebuild the adjusted mesh with uniformly spaced points.
panel = Panel("-100")
Z = UnitZ(Factor=panel)
move = Move(Geometry=sqgrid.Points, Motion=Z)  # -> Geometry, Transform
Z_2 = UnitZ(Factor=1)
meshray = MeshRay(Mesh=starting_mesh, Point=move.Geometry, Direction=Z_2)  # -> flatten(Point), Hit

# ----
# For the image to appear properly, the PictureFrame surface must start with the lower lefthand corner at 0,0,0
# right click on the Image Sampler components and select Image to set the image files. The numbers for domain-X and domain-Y are in Rhino model units. Use the numbers from the note below (generated from the dimensions of the PictureFrame surface) in the image sampler with the image used for the Rhino PictureFrame. Use the larger of the two numbers below as the X- or Y-domain of the second image sampler component, and calculate the other dimension according to the image proportions (hover over the image to quickly find the image proportions).
# 
# (e.g. if the second image is 800x600, and the numbers in the box below are 4000x2400, the second image domain should be 4000x3000.)
# The Elevation Multiplier determines the intensity of the Z-values coming from the grayscale image sampler.
# Part 1: Image Sampler mesh creation - Averaged images
pictureframe_surface_1 = Surface(<surface referenced from the Rhino model>)
# Adjust the influence slider to determine the weight coming from the two images (an influence of 0 is entirely determined by the top image and an influence of 1 is entirely determined by the bottom image).
influence = Slider(0.25, range=0..1)
_1 = Integer(1)
subtraction_3 = Subtraction(A=_1, B=influence)
elevation_multiplier = Slider(150, range=0..5000)

# ----
# Determine dimensions of PictureFrame surface to send to Image Sampler.
dim = Dimensions(Surface=pictureframe_surface_1)  # -> UDimension, VDimension
round = Round(Number=dim.UDimension)  # -> Nearest, Floor, Ceiling
round_2 = Round(Number=dim.VDimension)  # -> Nearest, Floor, Ceiling
division = Division(A=round.Nearest, B=cell_size_resolution)
division_2 = Division(A=round_2.Nearest, B=cell_size_resolution)
sdivide = DivideSurface(Surface=pictureframe_surface_1, UCount=division, VCount=division_2)  # -> Points, Normals, Parameters
flatten = FlattenTree(Data=sdivide.Points, Path="{0}")

panel_2 = Panel([round.Nearest, round_2.Nearest])
image = ImageSampler(
    flatten,
    FilePath="G:\Courses\2241\2012\Week 3\tutorial files\Image 1 - sand dunes.jpg",
    RelativeFilePath=".\Image 1 - sand dunes.jpg",
    Interpolate=True,
    Wrap=1,
    Umin=1,
    Umax=6176,
    Vmin=1,
    Vmax=4616,
    Filter="Value")
image_2 = ImageSampler(
    flatten,
    FilePath="G:\Courses\2241\2012\Week 3\tutorial files\Image 2 - swirls.jpg",
    RelativeFilePath=".\Image 2 - swirls.jpg",
    Interpolate=True,
    Wrap=1,
    Umin=1,
    Umax=6176,
    Vmin=1,
    Vmax=6176,
    Filter="Value")
multiplication = Multiplication(A=flatten(image), B=subtraction_3)
multiplication_2 = Multiplication(A=influence, B=flatten(image_2))
addition = Addition(A=multiplication, B=multiplication_2)
multiplication_3 = Multiplication(A=addition, B=elevation_multiplier)
pcomp_4 = Decompose(Point=flatten, System=PlaneXY(0, 0, 0))  # -> XComponent, YComponent, ZComponent
addition_2 = Addition(A=pcomp_4.ZComponent, B=multiplication_3)
pt = PointXYZ(XComponent=pcomp_4.XComponent, YComponent=pcomp_4.YComponent, ZComponent=addition_2, System=PlaneXY(0, 0, 0))
del = DelaunayMesh(Points=pt, Plane=PlaneXY(0, 0, 0))

# ----
# Intersect new image sampler mesh with XY grid points from original mesh. The intersection points will be used to rebuild the adjusted mesh with uniformly spaced points.
Z_3 = UnitZ(Factor=1)
meshray_2 = MeshRay(Mesh=del, Point=sqgrid.Points, Direction=Z_3)  # -> flatten(Point), Hit

# ----
# Add Z-values from image sampler mesh points to DEM mesh points
pcomp_5 = Decompose(Point=meshray_2.Point, System=PlaneXY(0, 0, 0))  # -> XComponent, YComponent, ZComponent
pcomp_6 = Decompose(Point=meshray.Point, System=PlaneXY(0, 0, 0))  # -> XComponent, YComponent, ZComponent

# ----
# Part 3: Combine image sampler mesh with original DEM mesh
clean = CleanTree(Data=pcomp_5.ZComponent, CleanInvalid=True, CleanEmpty=False)
sort = SortList(Keys=clean)  # -> Keys, ValuesA
item = ListItem(List=sort.Keys, Index="0", Wrap=False)
subtraction_4 = Subtraction(A=pcomp_5.ZComponent, B=item)

addition_3 = Addition(A=subtraction_4, B=pcomp_6.ZComponent)
pt_2 = PointXYZ(XComponent=pcomp_5.XComponent, YComponent=pcomp_5.YComponent, ZComponent=addition_3, System=PlaneXY(0, 0, 0))

# ----
# Project points from original and appended meshes to XY-plane to find points to replace (we want to replace overlapping points from the original mesh with the points from the appended mesh). Then remesh the merged points using a Delaunay component.
xy = XYPlane(Origin=Point(0, 0, 0))
project = Project(Geometry=meshray_2.Point, Plane=xy)  # -> Geometry, Transform
project_2 = Project(Geometry=meshray.Point, Plane=xy)  # -> Geometry, Transform
cp = ClosestPoint(Point=project.Geometry, Cloud=project_2.Geometry)  # -> ClosestPoint, CPIndex, Distance
replace = ListReplace(List=meshray.Point, Item=pt_2, Indices=cp.CPIndex, Wrap=False)  # -> flatten(List)
del_2 = DelaunayMesh(Points=replace, Plane=PlaneXY(0, 0, 0))
