# Grasshopper definition Week 7 - Succession.gh (Grasshopper 0.9.14)

# ----
# Bounding Box Dimensions:
# 
# In Rhino, select your base surface and use the command BoundingBox in the Top Viewport. Make sure that your bounding box, and your model, are located with the lower lefthand corner of the bounding box at 0,0,0. Select the bounding box, and in Grasshopper, right click Bounding Box to Set One Curve.
# bounding box dimensions
boundingbox = Curve(<curve referenced from the Rhino model>)
xz = XZPlane(Origin=Point(0, 0, 0))
yz = YZPlane(Origin=Point(0, 0, 0))
x_tremez = Extremes(Curve=boundingbox, Plane=yz)  # -> Highest, Lowest
x_tremez_2 = Extremes(Curve=boundingbox, Plane=xz)  # -> Highest, Lowest
pcomp = Decompose(Point=x_tremez.Highest)  # -> XComponent, YComponent, ZComponent
pcomp_2 = Decompose(Point=x_tremez.Lowest)  # -> XComponent, YComponent, ZComponent
pcomp_3 = Decompose(Point=x_tremez_2.Highest)  # -> XComponent, YComponent, ZComponent
pcomp_4 = Decompose(Point=x_tremez_2.Lowest)  # -> XComponent, YComponent, ZComponent
subtraction = Subtraction(A=pcomp.XComponent, B=pcomp_2.XComponent)
subtraction_2 = Subtraction(A=pcomp_3.YComponent, B=pcomp_4.YComponent)

# ----
# Hex Grid:
# 
# Adjust the size, and number of cells in the x and y direction to fit a hexagonal grid that matches up with the bounding box of your site.
# base grid (works as well with square, rect., or tri-grid)
size = Slider(2775.559, range=0..50000)
x_cells = Slider(20, range=0..200)
y_cells = Slider(20, range=0..100)
hexgrid = Hexagonal(Plane=PlaneXY(0, 0, 0), Size=size, ExtentX=x_cells, ExtentY=y_cells)  # -> Cells, Points; disabled

x_cells_2 = Slider(20, range=0..200)
y_cells_2 = Slider(15, range=0..100)
size_2 = Slider(2775.559, range=0..50000)
x_cells_3 = Slider(20, range=0..200)
y_cells_3 = Slider(20, range=0..100)
size_3 = Slider(202.663, range=0..2000)
trigrid = Triangular(Plane=PlaneXY(0, 0, 0), Size=size_2, ExtentX=x_cells_3, ExtentY=y_cells_3)  # -> Cells, Points; disabled
recgrid = Rectangular(Plane=PlaneXY(0, 0, 0), SizeX=size_3, SizeY=size_3, ExtentX=x_cells_2, ExtentY=y_cells_2)  # -> Cells, Points

# ----
# Image mapper:
# 
# Lets you sample image data into a grasshopper file.
# 
# 1. Size: Double click on the image samplers and use the values at in the yellow boxes for the upper bound of the x-domain and y-domain settings. Use 0 for the lower bound of each.
# 
# 2. Influence: lets you vary the effect of one image or the other. Low number for image 1, high number for image 2.
# image samplers
use_this_value_for_the_x_domain_in_the_i = Panel(subtraction)  # "Use this value for the X-domain in the image samplers"
use_this_value_for_the_y_domain_in_the_i = Panel(subtraction_2)  # "Use this value for the Y-domain in the image samplers"
pt = Point([hexgrid.Points, recgrid.Points, trigrid.Points])
influence = Slider(1, range=0..1)
image1 = ImageSampler(
    pt,
    FilePath="C:\Users\xrwang\Desktop\Week 8 - Flora and Fauna\Tutorial Files\shadow map.jpg",
    RelativeFilePath=".\shadow map.jpg",
    Interpolate=True,
    Wrap=1,
    Umin=0,
    Umax=4014.21875,
    Vmin=-3024.3125,
    Vmax=0,
    Filter="Value")
image2 = ImageSampler(
    pt,
    FilePath="C:\Users\xrwang\Desktop\Week 8 - Flora and Fauna\Tutorial Files\contamination map.jpg",
    RelativeFilePath=".\contamination map.jpg",
    Interpolate=True,
    Wrap=1,
    Umin=0,
    Umax=4014.21875,
    Vmin=-3024.3125,
    Vmax=0,
    Filter="Value")
subtraction_3 = Subtraction(A="1", B=influence)
multiplication = Multiplication(A=flatten(image1), B=subtraction_3)
multiplication_2 = Multiplication(A=influence, B=flatten(image2))
addition = Addition(A=multiplication, B=multiplication_2)

# ----
# cull trees/planting areas based on size
maximum_radius = Slider(0.45, range=0..100)
minimum_radius = Slider(0.25, range=0..1)
multiplication_3 = Multiplication(A=flatten(addition), B=maximum_radius)
max = Maximum(A=multiplication_3, B=minimum_radius)
mindex = MemberIndex(Set=max, Member=minimum_radius)  # -> Index, Count
replace = ListReplace(List=max, Indices=mindex.Index, Wrap=False)

# ----
# 2D Geometry:
# 
# Enable the Circle, Rectangle, or Polygon boxes below based on the type of geometry best expresses your vegetation patterning scheme.
cir = Circle(Plane=flatten([hexgrid.Points, recgrid.Points, trigrid.Points]), Radius=replace)
# create geometry
polygon = Polygon(Plane=flatten([hexgrid.Points, recgrid.Points, trigrid.Points]), Radius=replace, Segments=6, FilletRadius=0)  # -> Polygon, Length; disabled
rectangle = Rectangle(Plane=flatten([hexgrid.Points, recgrid.Points, trigrid.Points]), XSize=replace, YSize=replace, Radius=0)  # -> Rec, Length; disabled

# ----
# Base Surface:
# 
# Right click the Brep (surface) or Mesh box to set the surfaces/meshes you are using as a base.
brep = Brep([<brep referenced from the Rhino model> x4])
mesh = Mesh(<mesh referenced from the Rhino model>)
join = BrepJoin(Breps=brep)  # -> Breps, Closed
mesh_2 = MeshBrep(
    Brep=join.Breps,
    Settings={Refine=True, JaggedSeams=False, SimplePlanes=True, GridMinCount=16, GridMaxCount=0, Tolerance=0, RefineAngle=0, MinTolerance=0, RelativeTolerance=0.65, MinEdgeLength=0.0001, MaxEdgeLength=0})
mjoin = MeshJoin(Meshes=mesh_2)

# ----
# 3D Trees:
# 
# Enable the components in this group you are patterning trees of various canopy widths across your site.
pcen = PolygonCenter(Polyline=[rectangle.Rec, polygon.Polygon])  # -> CenterV, CenterE
cen = Center(Arc=cir)  # -> Center, Radius
trunk_radius = Slider(0.1, range=0..1)
trunk_height = Slider(1, range=0..15)
Z = UnitZ(Factor=1)
meshray = MeshRay(Mesh=[mjoin, mesh], Point=[pcen.CenterV, cen.Center], Direction=Z)  # -> Point, Hit
xy = XYPlane(Origin=meshray.Point)
Z_2 = UnitZ(Factor=trunk_height)
move = Move(Geometry=xy, Translation=Z_2)  # -> Geometry, Transform
sph = Sphere(Base=move.Geometry, Radius=replace)  # -> flatten(Sphere)
cyl = Cylinder(Base=xy, Radius=trunk_radius, Length=trunk_height)  # -> flatten(Cylinder)

# ----
# Projected Shapes:
# 
# Enable this component if your vegetation is in low groupings that follow the base surface.
project = Project(Curve=cir, Brep=join.Breps, Direction=Vector(0, 0, 1))  # -> flatten(Curve)

# ----
# Random Reduce:
# 
# 1. Enable the components in this group to randomly remove a number of items in a list, in this case, a percentage of trees/vegetation clusters.
# 2. Percent represents the factor to reduce the trees by.
# random reduce
percent = Slider(0.2, range=0..1)
lng = ListLength(List=[cir, project, sph, cyl, rectangle.Rec])
multiplication_4 = Multiplication(A=lng, B=percent)
reduce = RandomReduce(List=[project, sph, cyl], Reduction=multiplication_4, Seed=1)  # -> flatten(List)
