# Grasshopper definition Week 8 - Tracking movement across land.gh (Grasshopper 0.9.6)
# plug-ins: Kangaroo Components

# ----
# If you have interior and exterior boundaries, select the exterior (enclosing) curve as the exterior boundary and interior barrier curves as the interior boundaries.
# Adjusting for vegetation/hydrology (patches/edges/corridors)
interior_boundaries = Curve(<curve referenced from the Rhino model>)
exterior_boundary = Curve(<curve referenced from the Rhino model>)
Z = UnitZ(Factor=1000)
Z_2 = UnitZ(Factor=1000)
extr = Extrude(Base=exterior_boundary, Direction=Z)
extr_2 = Extrude(Base=interior_boundaries, Direction=Z_2)
cap = CapHoles(Brep=extr)
cap_2 = CapHoles(Brep=extr_2)
sdiff = SolidDifference(FirstSet=cap, SecondSet=cap_2)

# ----
# Start: set mesh, entrance curve, and exit curve from Rhino model
# Adjust this slider to control how many people, animals, vehicles, etc. (point particles) enter and meander through the site
# Starting parameters
slider = Slider(80, range=0..100)
entrance_curve = Curve(<curve referenced from the Rhino model>)
exit_curve = Curve(<curve referenced from the Rhino model>)
mesh = Mesh(<mesh referenced from the Rhino model>)
divide = DivideCurve(Curve=entrance_curve, Number=slider, Kinks=False)  # -> flatten(Points), Tangents, Parameters

# ----
# Color code mesh based on degree of slope
# Adjusting for topography
mcomp = Decompose(Mesh=mesh)  # -> Vertices, Faces, Colours, Normals
vcomp = Decompose(Vector=mcomp.Normals)  # -> XComponent, YComponent, ZComponent
eval = Evaluate(F="Deg(0.0 - (Asin(Abs(z)) - .5*Pi))", z=vcomp.ZComponent)
gradient = Gradient(LowerLimit=0, UpperLimit=90, Parameter=eval, stops=[0: RGB(0, 128, 0), 0.194: RGB(255, 255, 0), 0.371: RGB(255, 0, 0)])
mesh_2 = Mesh(Vertices=mcomp.Vertices, Faces=mcomp.Faces, Colours=gradient)

# ----
# Recreate mesh from only points that are below maximum slope
max_slope = Slider(4, range=0..90)
bool = Boolean(True)
smaller = SmallerThan(FirstNumber=eval, SecondNumber=max_slope)  # -> SmallerThan, OrEqualTo
mindex = MemberIndex(Set=smaller.OrEqualTo, Member=bool)  # -> Index, Count
item = ListItem(List=mcomp.Vertices, Index=mindex.Index, Wrap=False)
del = DelaunayMesh(Points=item, Plane=PlaneXY(0, 0, 0))

# ----
# Force 2: PLaw
# Simulating herding or individual behavior
# 
# Adjust the slider connected to strength:
# positive = repulsion (particles are repelled from each other and move more quickly to the exit)
# negative = attraction (particles are attracted to eachother and meander/linger)
# 
# Adjust the slider connected to cutoff:
# positive = the force only works below this distance
# negative = the force only works above this distance
# 0 = the force works at all distances
slider_2 = Slider(500, range=-500..500)
inter = InterconnectPoints(Pts=divide.Points)
plaw = PowerLaw(Connection=inter, Exponents=-2, Strength=slider_2, Cutoff=Slider(0, range=-1000..1000))

# ----
# Force 4: PullToMesh
# Simulating accessible topography
# 
# Adjust the slider connected to strength:
# positive = repulsion (particles are repelled from each other and move more quickly to the exit)
# negative = attraction (particles are attracted to eachother and meander/linger)
# 
# Adjust the slider connected to cutoff:
# positive = the force only works below this distance
# negative = the force only works above this distance
# 0 = the force works at all distances
slider_3 = Slider(200, range=-1000..1000)

# ----
# Force 5: CollideSurf
# Simulating patches and corridors (vegetation/hydrology)
# 
# Adjust the slider connected to strength:
# 0 - edges are "bouncy" (particles deflect off of patch edges)
# 1 - edges are "sticky" (particles stay near patch edges)
slider_4 = Slider(1, range=0..1)
collidesurf = CollideSurf(Solid=sdiff, Points=divide.Tangents, Hardness=slider_4)

# ----
# Force 1: PullToMesh
# Simulates gravity (for land-based animals...this can be disconnected for flying species)
# 
# Adjust the slider connected to strength:
# 0 = hard constraint (projection based)
# >1 = stronger mesh pull (beware, higher numbers cause particles to behave strangely)
slider_5 = Slider(100, range=0..100)
pulltomesh = PullToMesh(ConstraintMesh=mesh, Points=divide.Points, PullStrength=slider_5)

# ----
# Force 3: CurvePull
# Simulating movement through space (affects speed)
# 
# Adjust the slider connected to strength:
# 0 = slowest
# 1 = fastest, less dependent on other forces
slider_6 = Slider(0.1, range=0..1)
curvepull = CurvePull(Curve=exit_curve, Points=divide.Points, Strength=slider_6)

# ----
# Kangaroo Forces
pulltomesh_2 = PullToMesh(ConstraintMesh=del, Points=divide.Points, PullStrength=slider_3)

# ----
# Kangaroo Settings:
# 
# - TimeStep (How far through time the system moves at each iteration): lower numbers will be slower and smoother, higher numbers will be faster but jumpier
# 
# - SubIntervals (The number of iterations calculated between each time the solution is drawn on screen): lower numbers will make the simulation seem more continuous
# Set this slider to False to begin simulation. Set back to True to reset.
# Kangaroo Solver
toggle = BooleanToggle(False)
kangaroo_settings = KangarooSettings(
    Tolerance=0.001,
    TimeStep=0.05,
    SubIterations=1,
    Floor=False,
    Drag=1,
    Restitution=0.7,
    StaticFriction=10,
    KineticFriction=10,
    Settle=2,
    Tumble=1,
    Sound=False,
    Solver=0)
kangaroo = KangarooPhysics(
    ForceObjects=flatten([plaw, curvepull, pulltomesh, pulltomesh_2, collidesurf]),
    Settings=kangaroo_settings,
    SimulationReset=toggle)  # -> Out, Iterations, ParticlesOut, GeometryOut
timer = Timer(TimerInterval=20, Target=kangaroo)

T = Trail(Points=kangaroo.ParticlesOut, Reset=toggle, Record=True)
