# Grasshopper definition attractor_repulsor_resultantlines.gh (Grasshopper 0.8.63)

# ---- group: vertical grid interval
curve = Curve(<curve referenced from the Rhino model>)
panel = Panel(".4")
series = Series(Start=0, Step=Slider(1, range=0..1), Count=Slider(10, range=0..21))
offset = Offset(Curve=curve, Distance=series, Plane=PlaneXY(0, 0, 0), Corners=1)

# ----
point_attractor_pt = Point(<point referenced from the Rhino model>)  # disabled
point_field_points = Point()  # disabled
number_slider = Slider(-1.34, range=-2..2)  # disabled
vector_2pt = Vector2Pt(PointA=point_field_points, PointB=point_attractor_pt, Unitize=False)  # -> Vector, Length; disabled
panel_2 = Panel(".375")  # disabled
number_slider_2 = Slider(0.65, range=0..5)  # disabled
power = Power(A=vector_2pt.Length, B=number_slider)  # disabled
vector_display = VectorDisplay(Anchors=point_field_points, Vectors=vector_2pt.Vector, stops=[0: None, 0: None, 0: None])  # disabled
minimum = Minimum(A=power, B=panel_2)  # disabled
panel_3 = Panel(minimum)  # disabled
line_sdl = LineSDL(Start=point_field_points, Direction=vector_2pt.Vector, Length=minimum)  # disabled

# ---- group: exponential horiz grid
series_2 = Series(Start=0, Step=1, Count=Slider(32.92, range=0..40))
curve_2 = Curve(<curve referenced from the Rhino model>)
power_2 = Power(A=series_2, B=Slider(0.562, range=0..1))
panel_4 = Panel(power_2)
offset_2 = Offset(Curve=curve_2, Distance=power_2, Plane=PlaneXY(0, 0, 0), Corners=1)

# ---- group: tree attractor
number_slider_3 = Slider(0.5, range=0..5)  # disabled
number_slider_4 = Slider(0.5, range=0..5)  # disabled
number_slider_5 = Slider(14, range=0..14)  # disabled
number_slider_6 = Slider(18, range=0..18)  # disabled
point_attractor_pt_2 = Point(<point referenced from the Rhino model>)  # disabled
rectangular = Rectangular(Plane=PlaneXY(0, 0, 0), SizeX=number_slider_3, SizeY=number_slider_4, ExtentX=number_slider_5, ExtentY=number_slider_6)  # -> Cells, Points; disabled
point_field_points_2 = Point([<point referenced from the Rhino model> x5000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])  # disabled
number_slider_7 = Slider(0.75, range=-2..2)  # disabled
vector_2pt_2 = Vector2Pt(PointA=point_field_points_2, PointB=point_attractor_pt_2, Unitize=False)  # -> Vector, Length; disabled
number_slider_8 = Slider(0.175, range=0..1)  # disabled
power_3 = Power(A=vector_2pt_2.Length, B=number_slider_7)  # disabled
minimum_2 = Minimum(A=power_3, B=number_slider_8)  # disabled
line_sdl_2 = LineSDL(Start=point_field_points_2, Direction=vector_2pt_2.Vector, Length=minimum_2)  # disabled
end_points = EndPoints(Curve=line_sdl_2)  # -> Start, End; disabled
point = Point(end_points.Start)  # disabled
point_2 = Point(end_points.End)  # disabled
polyline = PolyLine(Vertices=point_2, Closed=False)  # disabled

# ---- group: picnic repulsion
point_repulsor_pt = Point(<point referenced from the Rhino model>)
rectangular_2 = Rectangular(
    Plane=PlaneXY(0, 0, 0),
    SizeX=Slider(0.5, range=0..5),
    SizeY=Slider(0.5, range=0..5),
    ExtentX=Slider(14, range=0..14),
    ExtentY=Slider(18, range=0..18))  # -> Cells, Points
point_field_points_3 = Point([<point referenced from the Rhino model> x5000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])
vector_2pt_3 = Vector2Pt(PointA=point_repulsor_pt, PointB=point_field_points_3, Unitize=False)  # -> Vector, Length
power_4 = Power(A=vector_2pt_3.Length, B=Slider(0.75, range=-2..2))
minimum_3 = Minimum(A=power_4, B=Slider(0.175, range=0..1))
line_sdl_3 = LineSDL(Start=point_field_points_3, Direction=vector_2pt_3.Vector, Length=minimum_3)
end_points_2 = EndPoints(Curve=line_sdl_3)  # -> Start, End
point_3 = Point(end_points_2.Start)
point_4 = Point(end_points_2.End)
polyline_2 = PolyLine(Vertices=point_4, Closed=False)

# ---- group: grid line bake machine
point_5 = Point([<point referenced from the Rhino model> x36])
polyline_3 = PolyLine(Vertices=point_5, Closed=False)
