# Grasshopper definition attractors vector deformation_Co-de-iT_GH0657.ghx (Grasshopper 0.6.57)

geo = Geometry([<19, culture=neutral, publickeytoken=null referenced from the Rhino model> x786])
planar = PlanarSrf(E=geo)
pt = Point(<point referenced from the Rhino model>)
pt_2 = Point(<point referenced from the Rhino model>)
# attractors vector deformation_Co-de-iT_GH0657
# 
# The complex structure of radiolaria was treated as a two-dimensional representation with a hexagonal pattern. Two points control the deformation of individual cells that make structure through a transformation of vectors connecting the vertices of the single cell with the point. The deformation of the grid can be caused by an attraction or a repulsion generated by attractor points.
# 
# 
# 
# © Co-de-iT 2010
explode = BRepComponents(B=planar)  # -> F, E, V
vec2pt = Vector2Pt(A=explode.V, B=pt, U=False)  # -> V, L
vec2pt_2 = Vector2Pt(A=explode.V, B=pt_2, U=False)  # -> V, L
larger = LargerThan(A=vec2pt.L, B=vec2pt_2.L)  # -> port, port_2
not = GateNot(A=larger.port)
cull = CullPattern(L=vec2pt.V, P=not)
cull_2 = CullPattern(L=vec2pt_2.L, P=larger.port)
cull_3 = CullPattern(L=vec2pt.L, P=not)
cull_4 = CullPattern(L=vec2pt_2.V, P=larger.port)
weave = Weave(P=larger.port, _0=cull, _1=cull_4, NullGaps=False)
weave_2 = Weave(P=larger.port, _0=cull_3, _1=cull_2, NullGaps=False)
flatten = FlattenTree(D=weave_2, P="{0}")
lng = ListLength(L=flatten)
sort = SortList(K=flatten)  # -> K, A
minus = Subtraction(A=lng, B=1)
influence = Slider(0.9232974035, range=0..1)
item_min = ListItem(L=sort.K, i=0, W=False)
item_max = ListItem(L=sort.K, i=minus, W=False)
# graph mapper is just for fun, for original definition connect function directly into vector multiplication.
f_x_y_z = F3(F="1-((x-y)/(z-y))", x=weave_2, y=item_min, z=item_max)
graph = GraphMapper(
    f_x_y_z,
    x0=0,
    x1=1,
    y0=0,
    y1=1,
    container_name="Bezier",
    cpx=[0, 0.9953631163, 0.3646381795, 1],
    cpy=[0, 0, 0.4906660914, 1])
mul = Multiply(V=weave, F=graph)  # -> V, L
mul_2 = Multiply(V=mul.V, F=influence)  # -> V, L
dis = Display(A=explode.V, V=mul_2.V, stops=[0: None, 0: None, 0: None])
move = Move(G=explode.V, T=mul_2.V)
crv = Curve(V=move, D=2, P=True)  # -> C, L, D
pline = PolyLine(V=move, C=True)
planar_2 = PlanarSrf(E=pline)
preview = CustomPreview(G=pline, S=ColourSwatch(SwatchColor=RGB(0, 0, 0)))
