# Grasshopper definition closest point - multiple curves.gh (Grasshopper 0.9.6)

panel = Panel("Input Curve")
crv = Curve([<curve referenced from the Rhino model> x5])
grid_size = Slider(10, range=0..20)
of_xy_points = Slider(42, range=0..50)
of_xy_points_2 = Slider(20, range=0..20)
# Create a Grid of Points
series = Series(Start=0, Step=grid_size, Count=of_xy_points)
# Find distance from points to the curve
pt = PointXYZ(XComponent=series, YComponent=graft(series), ZComponent=0, System=PlaneXY(0, 0, 0))  # -> flatten(Point)
divide = DivideCurve(Curve=crv, Count=of_xy_points_2, Kinks=False)  # -> flatten(Points), Tangents, Parameters
cp = ClosestPoint(Point=pt, Cloud=divide.Points)  # -> ClosestPoint, CPIndex, Distance
dist = Distance(PointA=pt, PointB=cp.ClosestPoint)
multiplication = Multiplication(A=dist, B=Slider(0.05, range=0..20))
addition = Addition(A=multiplication, B=Slider(1, range=0..20))
cir = Circle(Plane=pt, Radius=addition)
