# Grasshopper definition closest point radius.gh (Grasshopper 0.9.6)

panel = Panel("Input Curve")
crv = Curve(<curve referenced from the Rhino model>)
grid_size = Slider(7.05, range=0..20)
of_xy_points = Slider(20, range=0..20)
# Create a Grid of Points
series = Series(Start=0, Step=grid_size, Count=of_xy_points)
pt = PointXYZ(XComponent=series, YComponent=graft(series), ZComponent=0, System=PlaneXY(0, 0, 0))
# Find distance from points to the curve
crv_cp = CurveCP(Point=pt, Curve=crv)  # -> Point, Parameter, Distance
multiplication = Multiplication(A=crv_cp.Distance, B=Slider(0.05, range=0..20))
addition = Addition(A=multiplication, B=Slider(0.45, range=0..20))
cir = Circle(Plane=pt, Radius=addition)
