# Grasshopper definition grid modual.gh (Grasshopper 0.9.14)
# plug-ins: PTComponentLibrary

panel = Panel("attractor curve/coastline")
panel_2 = Panel("surface of coast(line)")
panel_3 = Panel("module")
panel_4 = Panel("flat surface")
pt = Point([<point referenced from the Rhino model> x26])
crv = Curve(<curve referenced from the Rhino model>)
brep = Brep(<brep referenced from the Rhino model>)
srf = Surface(<surface referenced from the Rhino model>)
crv_2 = Curve(<curve referenced from the Rhino model>)
srf_2 = Surface(<surface referenced from the Rhino model>)
divide = DivideCurve(Curve=crv, Count=Slider(200, range=0..1000), Kinks=False)  # -> Points, Tangents, Parameters
# bounding box for module
bbox = BoundingBox(Content=brep, Plane=PlaneXY(0, 0, 0))  # -> Box, Box_2
ptsrfdomnum = SurfaceDomainNumber(Surface=srf, UNumber=10, VNumber=10)
# magnitude of attraction to coast line/curve attractor
slider = Slider(3, range=0..10)
cp = ClosestPoint(Point=pt, Cloud=divide.Points)  # -> ClosestPoint, CPIndex, Distance
ptcrvatts = CurveAttraction(Grid=ptsrfdomnum, CrvAtts=crv_2, Magnitude=slider)  # -> Grid, Weights
ln = Line(StartPoint=pt, EndPoint=cp.ClosestPoint)
pt_2 = Point(ptcrvatts.Grid)
Z = UnitZ(Factor=1)
len = Length(Curve=ln)
slider_2 = Slider(100, range=0..100)
panel_5 = Panel(len)
project = ProjectPoint(Point=pt_2, Direction=Z, Geometry=srf_2)  # -> Point, Index
points = PointList(Points=project.Point, Tags=True, Lines=True)
division = Division(A=panel_5, B=Slider(18, range=0..100))
cir = Circle(Plane=pt, Radius=division)
ptmorph3d = Morph3D(
    Grid1=ptcrvatts.Grid,
    Grid2=project.Point,
    PatternObjects=brep,
    BoundingObjects=bbox.Box,
    Shift_i=1,
    Shift_j=1,
    Pull=False)
