# Grasshopper definition jasonbrainmorning5.gh (Grasshopper 0.8.63)

unit_z = UnitZ(Factor=-50000)
unit_z_2 = UnitZ(Factor=50000)

surface = Surface(<surface referenced from the Rhino model>)

divide_domain² = DivideDomain²(Domain=surface, UCount=Slider(18, range=0..51), VCount=Slider(14, range=0..51))
isotrim = Isotrim(Surface=surface, Domain=divide_domain²)
area = Area(Geometry=isotrim)  # -> Area, Centroid

# ---- group: points moved down in space
move = Move(Geometry=area.Centroid, Motion=unit_z)  # -> Geometry, Transform

# ---- group: points moved up in space
move_2 = Move(Geometry=area.Centroid, Motion=unit_z_2)  # -> Geometry, Transform

# ----
surface_relay = Surface(isotrim)
surface_relay_2 = Surface(isotrim)

# ---- group: low points
surface_cp = SurfaceCP(Point=move.Geometry, Surface=surface_relay)  # -> Point, UVPoint, Distance

# ---- group: high points
surface_cp_2 = SurfaceCP(Point=move_2.Geometry, Surface=surface_relay)  # -> Point, UVPoint, Distance

# ---- group: low-to-high vector
vector_2pt = Vector2Pt(PointA=surface_cp.Point, PointB=surface_cp_2.Point, Unitize=False)  # -> Vector, Length

# ----
decompose = Decompose(Vector=vector_2pt.Vector)  # -> XComponent, YComponent, ZComponent
vector_display = VectorDisplay(Anchors=surface_cp.Point)

# ---- group: hypotenuse
square = Square(Value=decompose.YComponent)  # disabled
square_2 = Square(Value=decompose.XComponent)  # disabled
addition = Addition(A=square_2, B=square)  # disabled
square_root = SquareRoot(Value=addition)  # disabled

# ---- group: hypotenuse (alternative)
f2 = F2(Function="(x²+y²)^.5", X=decompose.XComponent, Y=decompose.YComponent)

# ---- group: drop
number = Number(decompose.ZComponent)

# ---- group: slope
division = Division(A=number, B=f2)

# ----
panel = Panel(division)

domain = Domain(DomainStart="0.8", DomainEnd="0.9")
includes = Includes(Value=panel, Domain=domain)  # -> Includes, Deviation
cull_pattern = CullPattern(List=surface_relay_2, CullPattern=includes.Includes)

domain_2 = Domain(DomainStart="0.9", DomainEnd="1.0")
includes_2 = Includes(Value=panel, Domain=domain_2)  # -> Includes, Deviation
cull_pattern_2 = CullPattern(List=surface_relay_2, CullPattern=includes_2.Includes)

domain_3 = Domain(DomainStart="0.0", DomainEnd="0.1")
includes_3 = Includes(Value=panel, Domain=domain_3)  # -> Includes, Deviation
cull_pattern_3 = CullPattern(List=surface_relay_2, CullPattern=includes_3.Includes)

domain_4 = Domain(DomainStart="1.0", DomainEnd="1.1")
includes_4 = Includes(Value=panel, Domain=domain_4)  # -> Includes, Deviation
cull_pattern_4 = CullPattern(List=surface_relay_2, CullPattern=includes_4.Includes)

domain_5 = Domain(DomainStart="1.5", DomainEnd="1.6")
includes_5 = Includes(Value=panel, Domain=domain_5)  # -> Includes, Deviation
cull_pattern_5 = CullPattern(List=surface_relay_2, CullPattern=includes_5.Includes)

domain_6 = Domain(DomainStart="0.1", DomainEnd="0.2")
includes_6 = Includes(Value=panel, Domain=domain_6)  # -> Includes, Deviation
cull_pattern_6 = CullPattern(List=surface_relay_2, CullPattern=includes_6.Includes)

domain_7 = Domain(DomainStart="0.7", DomainEnd="0.8")
includes_7 = Includes(Value=panel, Domain=domain_7)  # -> Includes, Deviation
cull_pattern_7 = CullPattern(List=surface_relay_2, CullPattern=includes_7.Includes)

domain_8 = Domain(DomainStart="1.2", DomainEnd="1.3")
includes_8 = Includes(Value=panel, Domain=domain_8)  # -> Includes, Deviation
cull_pattern_8 = CullPattern(List=surface_relay_2, CullPattern=includes_8.Includes)

domain_9 = Domain(DomainStart="1.3", DomainEnd="1.4")
includes_9 = Includes(Value=panel, Domain=domain_9)  # -> Includes, Deviation
cull_pattern_9 = CullPattern(List=surface_relay_2, CullPattern=includes_9.Includes)

domain_10 = Domain(DomainStart="0.2", DomainEnd="0.3")
includes_10 = Includes(Value=panel, Domain=domain_10)  # -> Includes, Deviation
cull_pattern_10 = CullPattern(List=surface_relay_2, CullPattern=includes_10.Includes)

domain_11 = Domain(DomainStart="0.6", DomainEnd="0.7")
includes_11 = Includes(Value=panel, Domain=domain_11)  # -> Includes, Deviation
cull_pattern_11 = CullPattern(List=surface_relay_2, CullPattern=includes_11.Includes)

domain_12 = Domain(DomainStart="1.7", DomainEnd="1.8")
includes_12 = Includes(Value=panel, Domain=domain_12)  # -> Includes, Deviation
cull_pattern_12 = CullPattern(List=surface_relay_2, CullPattern=includes_12.Includes)

domain_13 = Domain(DomainStart="1.4", DomainEnd="1.5")
includes_13 = Includes(Value=panel, Domain=domain_13)  # -> Includes, Deviation
cull_pattern_13 = CullPattern(List=surface_relay_2, CullPattern=includes_13.Includes)

domain_14 = Domain(DomainStart="0.3", DomainEnd="0.4")
includes_14 = Includes(Value=panel, Domain=domain_14)  # -> Includes, Deviation
cull_pattern_14 = CullPattern(List=surface_relay_2, CullPattern=includes_14.Includes)

domain_15 = Domain(DomainStart="0.5", DomainEnd="0.6")
includes_15 = Includes(Value=panel, Domain=domain_15)  # -> Includes, Deviation
cull_pattern_15 = CullPattern(List=surface_relay_2, CullPattern=includes_15.Includes)

domain_16 = Domain(DomainStart="1.6", DomainEnd="1.7")
includes_16 = Includes(Value=panel, Domain=domain_16)  # -> Includes, Deviation
cull_pattern_16 = CullPattern(List=surface_relay_2, CullPattern=includes_16.Includes)

domain_17 = Domain(DomainStart="1.1", DomainEnd="1.2")
includes_17 = Includes(Value=panel, Domain=domain_17)  # -> Includes, Deviation
cull_pattern_17 = CullPattern(List=surface_relay_2, CullPattern=includes_17.Includes)

domain_18 = Domain(DomainStart="0.4", DomainEnd="0.5")
includes_18 = Includes(Value=panel, Domain=domain_18)  # -> Includes, Deviation
cull_pattern_18 = CullPattern(List=surface_relay_2, CullPattern=includes_18.Includes)
