# Grasshopper definition jasonsassign4afternoon.gh (Grasshopper 0.8.63)

# ---- group: morning notes copied in
surface = Surface()  # disabled
gridded_surface = Surface(<surface referenced from the Rhino model>)  # disabled

geometry = Geometry()  # disabled
cell_object = Geometry(<20, culture=neutral, publickeytoken=null referenced from the Rhino model>)  # disabled

number_slider = Slider(7, range=0..9)  # disabled
number_slider_2 = Slider(7, range=0..9)  # disabled
bounding_box = BoundingBox(Content=cell_object, Union=False, Plane=PlaneXY(0, 0, 0))  # -> Box, Box_2; disabled
divide_domain² = DivideDomain²(Domain=gridded_surface, UCount=number_slider, VCount=number_slider_2)  # disabled
box_components = BoxComponents(Box=bounding_box.Box)  # -> Plane, X, Y, Z; disabled
surface_box = SurfaceBox(Surface=gridded_surface, Domain=divide_domain², Height=box_components.Z)  # disabled
box_morph = BoxMorph(Geometry=cell_object, Reference=bounding_box.Box_2, Target=surface_box)  # disabled
number_slider_3 = Slider(2, range=0..9)  # disabled
brep_join = BrepJoin(Breps=box_morph)  # -> Breps, Closed; disabled
cull_pattern = CullPattern(List=box_morph, CullPattern=[False, True, False])  # disabled
cull_nth = CullNth(List=box_morph, CullFrequency=number_slider_3)  # disabled

# ---- group: gleaned values 0<x<1 from black/white image picturedframe on surface
surface_2 = Surface(<surface referenced from the Rhino model>)
divide_domain²_2 = DivideDomain²(Domain=surface_2, UCount=Slider(20, range=0..35), VCount=Slider(23, range=0..35))
isotrim = Isotrim(Surface=surface_2, Domain=divide_domain²_2)
area = Area(Geometry=isotrim)  # -> Area, Centroid
image_sampler = ImageSampler(
    area.Centroid,
    FilePath="C:\Users\Jason Brain\Documents\GSDMLA1.1.2\presemester\assign4\exportedgradient-01-01.jpg",
    RelativeFilePath=".\exportedgradient-01-01.jpg",
    Interpolate=False,
    Wrap=1,
    Umin=0,
    Umax=9,
    Vmin=0,
    Vmax=7,
    Filter="Value")
panel = Panel(image_sampler)
sort_list = SortList(Keys=image_sampler, ValuesValuesA=isotrim)  # -> Keys, ValuesValuesA
panel_2 = Panel(sort_list.Keys)

# ---- group: black/white domain values 0<x<1 for module 8/8
domain = Domain(DomainStart="0.875", DomainEnd="1.0")
includes = Includes(Value=sort_list.Keys, Domain=domain)  # -> Includes, Deviation
cull_pattern_2 = CullPattern(List=sort_list.ValuesValuesA, CullPattern=includes.Includes)
surface_3 = Surface(cull_pattern_2)

# ---- group: black/white domain values 0<x<1 for module 6/8
domain_2 = Domain(DomainStart="0.625", DomainEnd="0.750")
includes_2 = Includes(Value=sort_list.Keys, Domain=domain_2)  # -> Includes, Deviation
cull_pattern_3 = CullPattern(List=sort_list.ValuesValuesA, CullPattern=includes_2.Includes)
surface_4 = Surface(cull_pattern_3)

# ---- group: black/white domain values 0<x<1 for module 5/8
domain_3 = Domain(DomainStart="0.5", DomainEnd="0.625")
includes_3 = Includes(Value=sort_list.Keys, Domain=domain_3)  # -> Includes, Deviation
cull_pattern_4 = CullPattern(List=sort_list.ValuesValuesA, CullPattern=includes_3.Includes)
surface_5 = Surface(cull_pattern_4)

# ---- group: black/white domain values 0<x<1 for module 1/8
domain_4 = Domain(DomainStart="0.0", DomainEnd="0.125")
includes_4 = Includes(Value=sort_list.Keys, Domain=domain_4)  # -> Includes, Deviation
cull_pattern_5 = CullPattern(List=sort_list.ValuesValuesA, CullPattern=includes_4.Includes)
surface_6 = Surface(cull_pattern_5)

# ---- group: black/white domain values 0<x<1 for module 7/8
domain_5 = Domain(DomainStart="0.750", DomainEnd="0.875")
includes_5 = Includes(Value=sort_list.Keys, Domain=domain_5)  # -> Includes, Deviation
cull_pattern_6 = CullPattern(List=sort_list.ValuesValuesA, CullPattern=includes_5.Includes)
surface_7 = Surface(cull_pattern_6)

# ---- group: black/white domain values 0<x<1 for module 3/8
domain_6 = Domain(DomainStart="0.250", DomainEnd="0.375")
includes_6 = Includes(Value=sort_list.Keys, Domain=domain_6)  # -> Includes, Deviation
cull_pattern_7 = CullPattern(List=sort_list.ValuesValuesA, CullPattern=includes_6.Includes)
surface_8 = Surface(cull_pattern_7)

# ---- group: black/white domain values 0<x<1 for module 4/8
domain_7 = Domain(DomainStart="0.375", DomainEnd="0.5")
includes_7 = Includes(Value=sort_list.Keys, Domain=domain_7)  # -> Includes, Deviation
cull_pattern_8 = CullPattern(List=sort_list.ValuesValuesA, CullPattern=includes_7.Includes)
surface_9 = Surface(cull_pattern_8)

# ---- group: black/white domain values 0<x<1 for module 2/8
domain_8 = Domain(DomainStart="0.125", DomainEnd="0.250")
includes_8 = Includes(Value=sort_list.Keys, Domain=domain_8)  # -> Includes, Deviation
cull_pattern_9 = CullPattern(List=sort_list.ValuesValuesA, CullPattern=includes_8.Includes)
surface_10 = Surface(cull_pattern_9)

# ---- group: module 2
cell_object_2 = Geometry(<20, culture=neutral, publickeytoken=null referenced from the Rhino model>)
bounding_box_2 = BoundingBox(Content=cell_object_2, Union=False, Plane=PlaneXY(0, 0, 0))  # -> Box, Box_2
box_components_2 = BoxComponents(Box=bounding_box_2.Box)  # -> Plane, X, Y, Z
surface_box_2 = SurfaceBox(Surface=surface_2, Domain=surface_10, Height=box_components_2.Z)
box_morph_2 = BoxMorph(Geometry=cell_object_2, Reference=bounding_box_2.Box_2, Target=surface_box_2)

# ---- group: module 3
cell_object_3 = Geometry(<20, culture=neutral, publickeytoken=null referenced from the Rhino model>)
bounding_box_3 = BoundingBox(Content=cell_object_3, Union=False, Plane=PlaneXY(0, 0, 0))  # -> Box, Box_2
box_components_3 = BoxComponents(Box=bounding_box_3.Box)  # -> Plane, X, Y, Z
surface_box_3 = SurfaceBox(Surface=surface_2, Domain=surface_8, Height=box_components_3.Z)
box_morph_3 = BoxMorph(Geometry=cell_object_3, Reference=bounding_box_3.Box_2, Target=surface_box_3)

# ---- group: module 1
cell_object_4 = Geometry(<20, culture=neutral, publickeytoken=null referenced from the Rhino model>)
bounding_box_4 = BoundingBox(Content=cell_object_4, Union=False, Plane=PlaneXY(0, 0, 0))  # -> Box, Box_2
box_components_4 = BoxComponents(Box=bounding_box_4.Box)  # -> Plane, X, Y, Z
surface_box_4 = SurfaceBox(Surface=surface_2, Domain=surface_6, Height=box_components_4.Z)
box_morph_4 = BoxMorph(Geometry=cell_object_4, Reference=bounding_box_4.Box_2, Target=surface_box_4)

# ---- group: module 4
cell_object_5 = Geometry(<20, culture=neutral, publickeytoken=null referenced from the Rhino model>)
bounding_box_5 = BoundingBox(Content=cell_object_5, Union=False, Plane=PlaneXY(0, 0, 0))  # -> Box, Box_2
box_components_5 = BoxComponents(Box=bounding_box_5.Box)  # -> Plane, X, Y, Z
surface_box_5 = SurfaceBox(Surface=surface_2, Domain=surface_9, Height=box_components_5.Z)
box_morph_5 = BoxMorph(Geometry=cell_object_5, Reference=bounding_box_5.Box_2, Target=surface_box_5)

# ---- group: module 5
cell_object_6 = Geometry(<20, culture=neutral, publickeytoken=null referenced from the Rhino model>)
bounding_box_6 = BoundingBox(Content=cell_object_6, Union=False, Plane=PlaneXY(0, 0, 0))  # -> Box, Box_2
box_components_6 = BoxComponents(Box=bounding_box_6.Box)  # -> Plane, X, Y, Z
surface_box_6 = SurfaceBox(Surface=surface_2, Domain=surface_5, Height=box_components_6.Z)
box_morph_6 = BoxMorph(Geometry=cell_object_6, Reference=bounding_box_6.Box_2, Target=surface_box_6)

# ---- group: module 6
cell_object_7 = Geometry(<20, culture=neutral, publickeytoken=null referenced from the Rhino model>)
bounding_box_7 = BoundingBox(Content=cell_object_7, Union=False, Plane=PlaneXY(0, 0, 0))  # -> Box, Box_2
box_components_7 = BoxComponents(Box=bounding_box_7.Box)  # -> Plane, X, Y, Z
surface_box_7 = SurfaceBox(Surface=surface_2, Domain=surface_4, Height=box_components_7.Z)
box_morph_7 = BoxMorph(Geometry=cell_object_7, Reference=bounding_box_7.Box_2, Target=surface_box_7)

# ---- group: module 7
cell_object_8 = Geometry(<20, culture=neutral, publickeytoken=null referenced from the Rhino model>)
bounding_box_8 = BoundingBox(Content=cell_object_8, Union=False, Plane=PlaneXY(0, 0, 0))  # -> Box, Box_2
box_components_8 = BoxComponents(Box=bounding_box_8.Box)  # -> Plane, X, Y, Z
surface_box_8 = SurfaceBox(Surface=surface_2, Domain=surface_7, Height=box_components_8.Z)
box_morph_8 = BoxMorph(Geometry=cell_object_8, Reference=bounding_box_8.Box_2, Target=surface_box_8)

# ---- group: module 8
cell_object_9 = Geometry(<20, culture=neutral, publickeytoken=null referenced from the Rhino model>)
bounding_box_9 = BoundingBox(Content=cell_object_9, Union=False, Plane=PlaneXY(0, 0, 0))  # -> Box, Box_2
box_components_9 = BoxComponents(Box=bounding_box_9.Box)  # -> Plane, X, Y, Z
surface_box_9 = SurfaceBox(Surface=surface_2, Domain=surface_3, Height=box_components_9.Z)
box_morph_9 = BoxMorph(Geometry=cell_object_9, Reference=bounding_box_9.Box_2, Target=surface_box_9)
