# Grasshopper definition jasonsinclassnotes.gh (Grasshopper 0.8.63)

# ---- group: applying one unit to a surface
surface = Surface()
gridded_surface = Surface(<surface referenced from the Rhino model>)

geometry = Geometry()
cell_object = Geometry(<20, culture=neutral, publickeytoken=null referenced from the Rhino model>)

bounding_box = BoundingBox(Content=cell_object, Union=False, Plane=PlaneXY(0, 0, 0))  # -> Box, Box_2
divide_domain² = DivideDomain²(Domain=gridded_surface, UCount=Slider(6, range=0..9), VCount=Slider(7, range=0..9))
box_components = BoxComponents(Box=bounding_box.Box)  # -> Plane, X, Y, Z
surface_box = SurfaceBox(Surface=gridded_surface, Domain=divide_domain², Height=box_components.Z)
box_morph = BoxMorph(Geometry=cell_object, Reference=bounding_box.Box_2, Target=surface_box)
brep_join = BrepJoin(Breps=box_morph)  # -> Breps, Closed; disabled
cull_pattern = CullPattern(List=box_morph, CullPattern=[False, True, False])
cull_nth = CullNth(List=box_morph, CullFrequency=Slider(2, range=0..9))
