# Grasshopper definition lines.ghx (Grasshopper 0.9.6)

crv = Curve([<curve referenced from the Rhino model> x3])
panel = Panel(crv)
unit = UnitVector(Vector=crv)
vcomp = Decompose(Vector=unit)  # -> XComponent, YComponent, ZComponent
# Abs(t) -->
gradient = Gradient(
    LowerLimit=0,
    UpperLimit=1,
    Parameter=expr("Abs(t)", vcomp.ZComponent),
    stops=[0: RGB(22, 219, 0), 0.426: RGB(255, 187, 0), 0.806: RGB(255, 0, 13)])
preview = CustomPreview(Geometry=crv, Shader=gradient)
