# Grasshopper definition mesh to surface ¡.ghx (Grasshopper 0.8.10)

mesh = Mesh(<mesh referenced from the Rhino model>)
mcomp = Decompose(Mesh=mesh)  # -> Vertices, Faces, Colours, Normals
panel = Panel(mcomp.Vertices)
dom = Domain(DomainStart=Slider(0, range=0..10), DomainEnd=Slider(31, range=0..31))
dom_2 = Domain(DomainStart=Slider(32, range=32..33), DomainEnd=Slider(63, range=32..63))
dom_3 = Domain(DomainStart=Slider(64, range=0..1000), DomainEnd=Slider(95, range=0..1000))
dom_4 = Domain(DomainStart=Slider(96, range=0..1000), DomainEnd=Slider(127, range=0..1000))
dom_5 = Domain(DomainStart=Slider(128, range=0..1000), DomainEnd=Slider(159, range=0..1000))
dom_6 = Domain(DomainStart=Slider(160, range=0..1000), DomainEnd=Slider(191, range=0..1000))
dom_7 = Domain(DomainStart=Slider(192, range=0..1000), DomainEnd=Slider(223, range=0..1000))
dom_8 = Domain(DomainStart=Slider(224, range=0..1000), DomainEnd=Slider(255, range=0..1000))
dom_9 = Domain(DomainStart=Slider(256, range=0..1000), DomainEnd=Slider(287, range=0..1000))
dom_10 = Domain(DomainStart=Slider(288, range=0..1000), DomainEnd=Slider(319, range=0..1000))
dom_11 = Domain(DomainStart=Slider(320, range=0..1000), DomainEnd=Slider(351, range=0..1000))
dom_12 = Domain(DomainStart=Slider(352, range=0..1000), DomainEnd=Slider(383, range=0..1000))
dom_13 = Domain(DomainStart=Slider(384, range=0..1000), DomainEnd=Slider(415, range=0..1000))
dom_14 = Domain(DomainStart=Slider(416, range=0..1000), DomainEnd=Slider(447, range=0..1000))
dom_15 = Domain(DomainStart=Slider(448, range=0..1000), DomainEnd=Slider(479, range=0..1000))
dom_16 = Domain(DomainStart=Slider(480, range=0..1000), DomainEnd=Slider(511, range=0..1000))
dom_17 = Domain(DomainStart=Slider(512, range=0..1000), DomainEnd=Slider(543, range=0..1000))
dom_18 = Domain(DomainStart=Slider(544, range=0..1000), DomainEnd=Slider(575, range=0..1000))
dom_19 = Domain(DomainStart=Slider(576, range=0..1000), DomainEnd=Slider(607, range=0..1000))
dom_20 = Domain(DomainStart=Slider(608, range=0..1000), DomainEnd=Slider(639, range=0..1000))
dom_21 = Domain(DomainStart=Slider(640, range=0..1000), DomainEnd=Slider(671, range=0..1000))
dom_22 = Domain(DomainStart=Slider(672, range=0..1000), DomainEnd=Slider(703, range=0..1000))
dom_23 = Domain(DomainStart=Slider(704, range=0..1000), DomainEnd=Slider(735, range=0..1000))
dom_24 = Domain(DomainStart=Slider(736, range=0..1000), DomainEnd=Slider(767, range=0..1000))
dom_25 = Domain(DomainStart=Slider(768, range=0..1000), DomainEnd=Slider(799, range=0..1000))
dom_26 = Domain(DomainStart=Slider(800, range=0..1000), DomainEnd=Slider(831, range=0..1000))
dom_27 = Domain(DomainStart=Slider(832, range=0..1000), DomainEnd=Slider(863, range=0..1000))
dom_28 = Domain(DomainStart=Slider(864, range=0..1000), DomainEnd=Slider(895, range=0..1000))
dom_29 = Domain(DomainStart=Slider(896, range=0..1000), DomainEnd=Slider(927, range=0..1000))
dom_30 = Domain(DomainStart=Slider(928, range=0..1000), DomainEnd=Slider(959, range=0..1000))
dom_31 = Domain(DomainStart=Slider(960, range=0..1000), DomainEnd=Slider(991, range=0..1000))
dom_32 = Domain(DomainStart=Slider(992, range=0..1000), DomainEnd=Slider(1023, range=0..1100))
subset = SubList(List=mcomp.Vertices, Interval=dom_10, Cycle=False)  # -> List, Index
subset_2 = SubList(List=mcomp.Vertices, Interval=dom, Cycle=False)  # -> List, Index
subset_3 = SubList(List=mcomp.Vertices, Interval=dom_2, Cycle=False)  # -> List, Index
subset_4 = SubList(List=mcomp.Vertices, Interval=dom_3, Cycle=False)  # -> List, Index
subset_5 = SubList(List=mcomp.Vertices, Interval=dom_4, Cycle=False)  # -> List, Index
subset_6 = SubList(List=mcomp.Vertices, Interval=dom_5, Cycle=False)  # -> List, Index
subset_7 = SubList(List=mcomp.Vertices, Interval=dom_6, Cycle=False)  # -> List, Index
subset_8 = SubList(List=mcomp.Vertices, Interval=dom_7, Cycle=False)  # -> List, Index
subset_9 = SubList(List=mcomp.Vertices, Interval=dom_8, Cycle=False)  # -> List, Index
subset_10 = SubList(List=mcomp.Vertices, Interval=dom_9, Cycle=False)  # -> List, Index
subset_11 = SubList(List=mcomp.Vertices, Interval=dom_11, Cycle=False)  # -> List, Index
subset_12 = SubList(List=mcomp.Vertices, Interval=dom_12, Cycle=False)  # -> List, Index
subset_13 = SubList(List=mcomp.Vertices, Interval=dom_13, Cycle=False)  # -> List, Index
subset_14 = SubList(List=mcomp.Vertices, Interval=dom_14, Cycle=False)  # -> List, Index
subset_15 = SubList(List=mcomp.Vertices, Interval=dom_15, Cycle=False)  # -> List, Index
subset_16 = SubList(List=mcomp.Vertices, Interval=dom_16, Cycle=False)  # -> List, Index
subset_17 = SubList(List=mcomp.Vertices, Interval=dom_17, Cycle=False)  # -> List, Index
subset_18 = SubList(List=mcomp.Vertices, Interval=dom_18, Cycle=False)  # -> List, Index
subset_19 = SubList(List=mcomp.Vertices, Interval=dom_19, Cycle=False)  # -> List, Index
subset_20 = SubList(List=mcomp.Vertices, Interval=dom_20, Cycle=False)  # -> List, Index
subset_21 = SubList(List=mcomp.Vertices, Interval=dom_21, Cycle=False)  # -> List, Index
subset_22 = SubList(List=mcomp.Vertices, Interval=dom_22, Cycle=False)  # -> List, Index
subset_23 = SubList(List=mcomp.Vertices, Interval=dom_23, Cycle=False)  # -> List, Index
subset_24 = SubList(List=mcomp.Vertices, Interval=dom_24, Cycle=False)  # -> List, Index
subset_25 = SubList(List=mcomp.Vertices, Interval=dom_25, Cycle=False)  # -> List, Index
subset_26 = SubList(List=mcomp.Vertices, Interval=dom_26, Cycle=False)  # -> List, Index
subset_27 = SubList(List=mcomp.Vertices, Interval=dom_27, Cycle=False)  # -> List, Index
subset_28 = SubList(List=mcomp.Vertices, Interval=dom_28, Cycle=False)  # -> List, Index
subset_29 = SubList(List=mcomp.Vertices, Interval=dom_29, Cycle=False)  # -> List, Index
subset_30 = SubList(List=mcomp.Vertices, Interval=dom_30, Cycle=False)  # -> List, Index
subset_31 = SubList(List=mcomp.Vertices, Interval=dom_31, Cycle=False)  # -> List, Index
subset_32 = SubList(List=mcomp.Vertices, Interval=dom_32, Cycle=False)  # -> List, Index
panel_2 = Panel(subset_2.List)
pt = Point(subset_2.List)
pt_2 = Point(subset_3.List)
pt_3 = Point(subset_4.List)
pt_4 = Point(subset_5.List)
pt_5 = Point(subset_6.List)
pt_6 = Point(subset_7.List)
pt_7 = Point(subset_8.List)
pt_8 = Point(subset_9.List)
pt_9 = Point(subset_10.List)
pt_10 = Point(subset.List)
pt_11 = Point(subset_11.List)
pt_12 = Point(subset_12.List)
pt_13 = Point(subset_13.List)
pt_14 = Point(subset_14.List)
pt_15 = Point(subset_15.List)
pt_16 = Point(subset_16.List)
pt_17 = Point(subset_17.List)
pt_18 = Point(subset_18.List)
pt_19 = Point(subset_19.List)
pt_20 = Point(subset_20.List)
pt_21 = Point(subset_21.List)
pt_22 = Point(subset_22.List)
pt_23 = Point(subset_23.List)
pt_24 = Point(subset_24.List)
pt_25 = Point(subset_25.List)
pt_26 = Point(subset_26.List)
pt_27 = Point(subset_27.List)
pt_28 = Point(subset_28.List)
pt_29 = Point(subset_29.List)
pt_30 = Point(subset_30.List)
pt_31 = Point(subset_31.List)
pt_32 = Point(subset_32.List)
crv = Curve(Vertices=pt_32, Degree=3, Periodic=False)  # -> Curve, Length, Domain
crv_2 = Curve(Vertices=pt, Degree=3, Periodic=False)  # -> Curve, Length, Domain
crv_3 = Curve(Vertices=pt_2, Degree=3, Periodic=False)  # -> Curve, Length, Domain
crv_4 = Curve(Vertices=pt_3, Degree=3, Periodic=False)  # -> Curve, Length, Domain
crv_5 = Curve(Vertices=pt_4, Degree=3, Periodic=False)  # -> Curve, Length, Domain
crv_6 = Curve(Vertices=pt_5, Degree=3, Periodic=False)  # -> Curve, Length, Domain
crv_7 = Curve(Vertices=pt_6, Degree=3, Periodic=False)  # -> Curve, Length, Domain
crv_8 = Curve(Vertices=pt_7, Degree=3, Periodic=False)  # -> Curve, Length, Domain
crv_9 = Curve(Vertices=pt_8, Degree=3, Periodic=False)  # -> Curve, Length, Domain
crv_10 = Curve(Vertices=pt_9, Degree=3, Periodic=False)  # -> Curve, Length, Domain
crv_11 = Curve(Vertices=pt_10, Degree=3, Periodic=False)  # -> Curve, Length, Domain
crv_12 = Curve(Vertices=pt_11, Degree=3, Periodic=False)  # -> Curve, Length, Domain
crv_13 = Curve(Vertices=pt_12, Degree=3, Periodic=False)  # -> Curve, Length, Domain
crv_14 = Curve(Vertices=pt_13, Degree=3, Periodic=False)  # -> Curve, Length, Domain
crv_15 = Curve(Vertices=pt_14, Degree=3, Periodic=False)  # -> Curve, Length, Domain
crv_16 = Curve(Vertices=pt_15, Degree=3, Periodic=False)  # -> Curve, Length, Domain
crv_17 = Curve(Vertices=pt_16, Degree=3, Periodic=False)  # -> Curve, Length, Domain
crv_18 = Curve(Vertices=pt_17, Degree=3, Periodic=False)  # -> Curve, Length, Domain
crv_19 = Curve(Vertices=pt_18, Degree=3, Periodic=False)  # -> Curve, Length, Domain
crv_20 = Curve(Vertices=pt_19, Degree=3, Periodic=False)  # -> Curve, Length, Domain
crv_21 = Curve(Vertices=pt_20, Degree=3, Periodic=False)  # -> Curve, Length, Domain
crv_22 = Curve(Vertices=pt_21, Degree=3, Periodic=False)  # -> Curve, Length, Domain
crv_23 = Curve(Vertices=pt_22, Degree=3, Periodic=False)  # -> Curve, Length, Domain
crv_24 = Curve(Vertices=pt_23, Degree=3, Periodic=False)  # -> Curve, Length, Domain
crv_25 = Curve(Vertices=pt_24, Degree=3, Periodic=False)  # -> Curve, Length, Domain
crv_26 = Curve(Vertices=pt_25, Degree=3, Periodic=False)  # -> Curve, Length, Domain
crv_27 = Curve(Vertices=pt_26, Degree=3, Periodic=False)  # -> Curve, Length, Domain
crv_28 = Curve(Vertices=pt_27, Degree=3, Periodic=False)  # -> Curve, Length, Domain
crv_29 = Curve(Vertices=pt_28, Degree=3, Periodic=False)  # -> Curve, Length, Domain
crv_30 = Curve(Vertices=pt_29, Degree=3, Periodic=False)  # -> Curve, Length, Domain
crv_31 = Curve(Vertices=pt_30, Degree=3, Periodic=False)  # -> Curve, Length, Domain
crv_32 = Curve(Vertices=pt_31, Degree=3, Periodic=False)  # -> Curve, Length, Domain
crv_33 = Curve(crv_13.Curve)
crv_34 = Curve(crv_2.Curve)
crv_35 = Curve(crv_3.Curve)
crv_36 = Curve(crv_4.Curve)
crv_37 = Curve(crv_5.Curve)
crv_38 = Curve(crv_6.Curve)
crv_39 = Curve(crv_7.Curve)
crv_40 = Curve(crv_8.Curve)
crv_41 = Curve(crv_9.Curve)
crv_42 = Curve(crv_10.Curve)
crv_43 = Curve(crv_11.Curve)
crv_44 = Curve(crv_12.Curve)
crv_45 = Curve(crv_14.Curve)
crv_46 = Curve(crv_15.Curve)
crv_47 = Curve(crv_16.Curve)
crv_48 = Curve(crv_17.Curve)
crv_49 = Curve(crv_18.Curve)
crv_50 = Curve(crv_19.Curve)
crv_51 = Curve(crv_20.Curve)
crv_52 = Curve(crv_21.Curve)
crv_53 = Curve(crv_22.Curve)
crv_54 = Curve(crv_23.Curve)
crv_55 = Curve(crv_24.Curve)
crv_56 = Curve(crv_25.Curve)
crv_57 = Curve(crv_26.Curve)
crv_58 = Curve(crv_27.Curve)
crv_59 = Curve(crv_28.Curve)
crv_60 = Curve(crv_29.Curve)
crv_61 = Curve(crv_30.Curve)
crv_62 = Curve(crv_31.Curve)
crv_63 = Curve(crv_32.Curve)
crv_64 = Curve(crv.Curve)
loft = Loft(
    Section=[crv_34, crv_35, crv_36, crv_37, crv_38, crv_39, crv_40, crv_41, crv_42, crv_43, crv_44, crv_33, crv_45, crv_46, crv_47, crv_48, crv_49, crv_50, crv_51, crv_52, crv_53, crv_54, crv_55, crv_56, crv_57, crv_58, crv_59, crv_60, crv_61, crv_62, crv_63, crv_64],
    Options={Adjust=False, Closed=False, Rebuild=10, Refit=0.01, LoftType=0, LoftEnds=0, LoftSimp=0})
Y = UnitY(Factor=Slider(4560, range=0..5000))
srf = Surface(loft)
move = Move(Geometry=srf, Translation=Y)  # -> Geometry, Transform
srf_2 = Surface(move.Geometry)
