# Grasshopper definition path through charges.gh (Grasshopper 0.9.6)

destination = Point(<point referenced from the Rhino model>)
pt = Point(<point referenced from the Rhino model>)
pt_2 = Point(<point referenced from the Rhino model>)
pt_3 = Point(<point referenced from the Rhino model>)
pt_4 = Point(<point referenced from the Rhino model>)
pt_5 = Point(<point referenced from the Rhino model>)
pcharge = PointCharge(Point=pt, Charge=Slider(-0.05, range=-1..1), Decay=2)
tag = TextTag(Location=pt, Text="Point 1")
pcharge_2 = PointCharge(Point=pt_2, Charge=Slider(0.15, range=-1..1), Decay=2)
tag_2 = TextTag(Location=pt_2, Text="Point 2")
pcharge_3 = PointCharge(Point=pt_3, Charge=Slider(-0.075, range=-1..1), Decay=2)
pcharge_4 = PointCharge(Point=pt_4, Charge=Slider(-0.375, range=-1..1), Decay=2)
tag_3 = TextTag(Location=pt_3, Text="Point 3")
tag_4 = TextTag(Location=pt_4, Text="Point 4")
pcharge_5 = PointCharge(Point=pt_5, Charge=Slider(-0.8, range=-1..1), Decay=2)
tag_5 = TextTag(Location=pt_5, Text="Point 5")
pcharge_6 = PointCharge(Point=destination, Charge=Slider(-12.5, range=-100..100), Decay=2)
tag_6 = TextTag(Location=destination, Text="Destination")
iterations = Slider(0, range=0..3000)
samples = Slider(1231.5, range=0..2000)
starting_point = Point(<point referenced from the Rhino model>)
# Merge all Fields to Create a Single Field
mergef = MergeFields(Fields=[pcharge, pcharge_2, pcharge_6, pcharge_3, pcharge_5, pcharge_4])
fline = FieldLine(Field=mergef, Point=starting_point, Steps=iterations, Accuracy=0.1, Method=3)
ftensor = TensorDisplay(
    Field=mergef,
    Section={Plane=PlaneXY(-43.21757191, -31.91869984, 0), Size=Domain2(u=0..98.981063, v=0..55.36019504)},
    Samples=samples)
pipe = Pipe(Curve=fline, Radius=0.5, Caps=0)
