# Grasshopper definition presemestergrass1.gh (Grasshopper 0.8.63)

curve = Curve(<curve referenced from the Rhino model>)
number_slider = Slider(1, range=0..1)
curve_2 = Curve(<curve referenced from the Rhino model>)
curve_3 = Curve(<curve referenced from the Rhino model>)
curve_4 = Curve(<curve referenced from the Rhino model>)
curve_5 = Curve(<curve referenced from the Rhino model>)
series = Series(Start=Slider(1, range=0..5), Step=Slider(1, range=0..5), Count=Slider(5, range=0..5))
field_of_points = Point([<point referenced from the Rhino model> x150])
flip = Flip(Curve=curve_3)  # -> Curve, Flag
point = Point(<point referenced from the Rhino model>)
flip_2 = Flip(Curve=curve_5)  # -> Curve, Flag
divide_curve = DivideCurve(Curve=curve_2, Count=Slider(5, range=0..5), Kinks=False)  # -> Points, Tangents, Parameters
divide_curve_2 = DivideCurve(Curve=curve_4, Count=Slider(5, range=0..5), Kinks=False)  # -> Points, Tangents, Parameters
divide_curve_3 = DivideCurve(Curve=flip_2.Curve, Count=Slider(5, range=0..5), Kinks=False)  # -> Points, Tangents, Parameters
divide_curve_4 = DivideCurve(Curve=flip.Curve, Count=Slider(5, range=0..5), Kinks=False)  # -> Points, Tangents, Parameters
vector_2pt = Vector2Pt(PointA=field_of_points, PointB=point, Unitize=False)  # -> Vector, Length
line = Line(StartPoint=divide_curve.Points, EndPoint=divide_curve_4.Points)
line_2 = Line(StartPoint=divide_curve_2.Points, EndPoint=divide_curve_3.Points)
power = Power(A=series, B=Slider(2, range=0..5))
vector_display = VectorDisplay(Anchors=field_of_points, Vectors=vector_2pt.Vector)
offset = Offset(Curve=curve, Distance=power, Plane=PlaneXY(0, 0, 0), Corners=1)
