# Grasshopper definition tree grower.gh (Grasshopper 0.9.14)

# ---- group: stick generator from base points
point = Point()
unit_z = UnitZ(Factor=Slider(2, range=0..20))
move = Move(Geometry=point, Motion=unit_z)  # -> Geometry, Transform
line = Line(StartPoint=point, EndPoint=move.Geometry)

# ---- group: tree trunk generator from points
height_of_tree_trunk = Slider(2, range=0..31)
base_center_point_of_trees = Point()
unit_z_2 = UnitZ(Factor=height_of_tree_trunk)
move_2 = Move(Geometry=base_center_point_of_trees, Motion=unit_z_2)  # -> Geometry, Transform
trunk_caliper = Slider(0.01, range=0..2)
trunk_axis = Line(StartPoint=base_center_point_of_trees, EndPoint=move_2.Geometry)
trunk = Pipe(Curve=trunk_axis, Radius=trunk_caliper, Caps=0)

# ---- group: circle generator from base points
point_2 = Point()
circle_cnr = CircleCNR(Center=point_2, Normal=Vector(0, 0, 1), Radius=Slider(1.4, range=0..2))
unit_z_3 = UnitZ(Factor=Slider(5, range=0..5))
move_3 = Move(Geometry=circle_cnr, Motion=unit_z_3)  # -> Geometry, Transform
