# Grasshopper definition turbulence.gh (Grasshopper 0.9.14)

pt_charge = Slider(6, range=0..15)
spin_charge = Slider(5, range=0..5)
md_slider = MDSlider(
    slider_value=Point(0.5760975349, 0.570975513, 0.5),
    x_domain=Domain(0, 3),
    y_domain=Domain(0, 3),
    z_domain=Domain(0, 1),
    SliderMode=0)
charges_sample_points = Slider(17, range=2..50)
base_sample_pt = Slider(18, range=2..50)
vector_field_scale_div = Slider(6, range=1..15)
color_value_cut = Slider(7, range=0..100)
pt = Point([<point referenced from the Rhino model> x6])
pt_2 = Point([<point referenced from the Rhino model> x32])
vect_line = Line(StartPoint=Point(0, 0, 0), EndPoint=md_slider)
range = Range(Domain=Domain(0, 20), Steps=base_sample_pt)
fvector = VectorForce(
    Line=vect_line,
    Bounds={Plane=Plane(origin=(0, 0, 0), x=(0, 1, 0), y=(1, 0, 0)), X=Domain(0, 20), Y=Domain(0, 20), Z=Domain(-20, 0)})
fspin = SpinForce(
    Plane=pt,
    Strength=spin_charge,
    Radius=5,
    Decay=2,
    Bounds={Plane=PlaneXY(0, 0, 0), X=Domain(0, 20), Y=Domain(0, 20), Z=Domain(0, 20)})
pcharge = PointCharge(
    Point=pt_2,
    Charge=pt_charge,
    Decay=2,
    Bounds={Plane=Plane(origin=(0, 0, 0), x=(0, 1, 0), y=(1, 0, 0)), X=Domain(0, 20), Y=Domain(0, 20), Z=Domain(-20, 0)})
pt_3 = PointXYZ(XComponent=graft(range), YComponent=range, ZComponent=0, System=PlaneXY(0, 0, 0))
cir = Circle(Plane=pt_2, Radius=1)
divide = DivideCurve(Curve=cir, Count=charges_sample_points, Kinks=False)  # -> Points, Tangents, Parameters
# You need to merge fields before use them together.
mergef = MergeFields(Fields=[pcharge, fvector, fspin])
pt_analysis_samples = Point([divide.Points, pt_3])
evf = EvaluateField(Field=mergef, Point=flatten(pt_analysis_samples))  # -> Tensor, Strength

# ----
# Turn-on to see force direction graph.
fdir = DirectionDisplay(Field=mergef, Section={Plane=PlaneXY(0, 0, 0), Size=Domain2(u=0..20, v=0..20)}, Samples=10000)

fline = FieldLine(Field=mergef, Point=flatten(pt_analysis_samples), Steps=500, Accuracy=0.03, Method=1)
panel = Panel(fline)

# ---- group: Taking out upper extremes
smaller = SmallerThan(FirstNumber=evf.Strength, SecondNumber=color_value_cut)  # -> SmallerThan, OrEqualTo
cull = CullPattern(List=evf.Strength, CullPattern=smaller.SmallerThan)

# ----
bnd = Bounds(Numbers=cull)
curve = Curve(fline)
domcomp = DomainComponents(Domain=bnd)  # -> Start, End
gradient = Gradient(
    LowerLimit=domcomp.Start,
    UpperLimit=domcomp.End,
    Parameter=evf.Strength,
    stops=[0: RGB(234, 38, 0), 0.25: RGB(234, 126, 0), 0.5: RGB(254, 244, 84), 0.75: RGB(173, 203, 249), 1: RGB(75, 107, 169)])
division = Division(A=evf.Tensor, B=vector_field_scale_div)
# Turn-on to see vectors
vdisex = VectorDisplayEx(Point=flatten(pt_analysis_samples), Vector=division, Colour=gradient, Width=2)
preview = CustomPreview(Geometry=fline, Shader=gradient)
