# Grasshopper definition zcontourstomesh.gh (Grasshopper 0.8.63)

curve = Curve([<curve referenced from the Rhino model> x112])
divide_curve = DivideCurve(Curve=curve, Count=Slider(29, range=0..91), Kinks=False)  # -> Points, Tangents, Parameters
flatten_tree = FlattenTree(Data=divide_curve.Points, Path="{0}")
delaunay_mesh = DelaunayMesh(Points=flatten_tree, Plane=PlaneXY(0, 0, 0))
